# Grasshopper definition 2024_WS_VPA_Final_LU_YE_cone.gh (Grasshopper 1.0.7)
# plug-ins: Bifocals, SpiralCurveG, LunchBox

number_of_horizontal_divisions = Slider(8, range=0..20)
number_of_vertical_divisions = Slider(18, range=0..40)
xy_plane = XYPlane(Origin=Point(0, 0, 0))
ghpython_script = GhPythonScript(x=xy_plane, y=Slider(5, range=0..10))  # -> out, myCircle, myCirclelist
# ---------- ghpython_script: Python ----------
__author__ = "luye6"
__version__ = "2024.11.13"

import rhinoscriptsyntax as rs
import Rhino.Geometry as rg

myPoint= rs.AddPoint(0,0,0)
myCirclelist = []

for i in range(0,10):
    myValue= 5 + 2*i
    myCircle= rs.AddCircle(myPoint, myValue)
    myCirclelist. append(myCircle)
    
a= myCirclelist
# ---------- end ghpython_script ----------
number_of_vertical_divisions_2 = Slider(15, range=0..40)
number_of_horizontal_divisions_2 = Slider(19, range=1..21)
base_radius = Slider(40, range=0..100)
height = Slider(60, range=0..100)
top_radius = Slider(15, range=0..100)
variable_a = Slider(10, range=0..10)
variable_b = Slider(10, range=0..10)
number_of_horizontal_divisions_3 = Slider(19, range=1..31)
variable_c = Slider(13, range=-1..20)

# ----
# construct point grid of the ellipsoid
# 
# Replace with Phyton Components
panel = Panel("-Pi")
construct_domain = ConstructDomain(DomainStart=panel, DomainEnd="Pi")
construct_domain_2 = ConstructDomain(DomainStart="0", DomainEnd="Pi/2")
range = Range(Domain=construct_domain, Steps=number_of_vertical_divisions)
range_2 = Range(Domain=construct_domain_2, Steps=number_of_horizontal_divisions)
cull_index = CullIndex(List=range, Indices=0, Wrap=True)  # -> graft(List)
expression = Expression(a=variable_a, u=cull_index, v=range_2, Expression="( a * cos(u) * sin(v) )")
expression_2 = Expression(b=variable_b, u=cull_index, v=range_2, Expression="( b * sin(u) * sin(v) )")
expression_3 = Expression(c=variable_c, u=cull_index, v=range_2, Expression="( c * cos(v) )")
construct_point = ConstructPoint(XCoordinate=expression, YCoordinate=expression_2, ZCoordinate=expression_3)

number_of_vertical_divisions_3 = Slider(15, range=0..40)
radius = Slider(40, range=0..100)
height_2 = Slider(60, range=0..100)
number_of_horizontal_divisions_4 = Slider(8, range=0..20)
variable_b_2 = Slider(10, range=0..10)
variable_a_2 = Slider(10, range=0..10)
number_of_vertical_divisions_4 = Slider(18, range=0..40)
variable_c_2 = Slider(10, range=-1..20)
ghpython_script_2 = GhPythonScript(V_Steps=number_of_vertical_divisions_2, H_Steps=number_of_horizontal_divisions_2, a=base_radius, b=height, c=top_radius)  # -> X, Y, Z, Tree, myTree, VD_Range, HD_Range, conePoints; inputs V_Steps: Int32, H_Steps: Int32, a: Int32, b: Int32, c: Int32
# ---------- ghpython_script_2: Python ----------
import rhinoscriptsyntax as rs
import Rhino.Geometry as rg
import math
import ghpythonlib.treehelpers as gt

# Define the interval for height (vertical range) and circular angle (horizontal range)
VD = rs.CreateInterval(0, 10)  # Height range
HD = rs.CreateInterval(0, 2 * math.pi)  # Full circle range

# Function to generate evenly spaced values within a given range
def myRange(domain, steps):
    start = domain[0]
    end = domain[1]
    step_size = (end - start) / steps
    Values = [start + i * step_size for i in range(steps + 1)]
    return Values

# Function to convert a list into a Data Tree structure
def Graft(List):
    myTree = []
    for i in range(len(List)):
        myTree.append([List[i]])  # Each item is placed in its own branch
    return gt.list_to_tree(myTree)

# Generate vertical and horizontal ranges
V_Steps = int(V_Steps)  # Vertical divisions
H_Steps = int(H_Steps)  # Horizontal divisions

VD_Range = myRange(VD, V_Steps)
HD_Range = myRange(HD, H_Steps)

# Convert ranges to Data Tree structures
VD_Tree = Graft(VD_Range)
HD_Tree = Graft(HD_Range)

# Function to calculate X coordinates for each point on the circular layers
def X_Coordinates(base_radius, top_radius, u, v):
    myTreeList = []
    for i in range(u.BranchCount):
        myBranchList = u.Branch(i)
        current_radius = base_radius + (top_radius - base_radius) * (myBranchList[0] / VD[1])
        myTempList = []
        for k in range(len(v)):
            x = current_radius * math.cos(v[k])
            myTempList.append(x)
        myTreeList.append(myTempList)
    return gt.list_to_tree(myTreeList)

# Function to calculate Y coordinates for each point on the circular layers
def Y_Coordinates(base_radius, top_radius, u, v):
    myTreeList = []
    for i in range(u.BranchCount):
        myBranchList = u.Branch(i)
        current_radius = base_radius + (top_radius - base_radius) * (myBranchList[0] / VD[1])
        myTempList = []
        for k in range(len(v)):
            y = current_radius * math.sin(v[k])
            myTempList.append(y)
        myTreeList.append(myTempList)
    return gt.list_to_tree(myTreeList)

# Function to calculate Z coordinates for each point along the height
def Z_Coordinates(height, u, v):
    myTreeList = []
    for i in range(u.BranchCount):
        myBranchList = u.Branch(i)
        myTempList = []
        for k in range(len(v)):
            z = myBranchList[0] * height / u.Branch(u.BranchCount - 1)[0]  # Normalize Z coordinate
            myTempList.append(z)
        myTreeList.append(myTempList)
    return gt.list_to_tree(myTreeList)


# Input values for the base radius, top radius, and height of the cone
base_radius = float(a)
top_radius = float(c)
height = float(b)

# Generate X, Y, Z coordinate trees
X = X_Coordinates(base_radius, top_radius, VD_Tree, HD_Range)
Y = Y_Coordinates(base_radius, top_radius, VD_Tree, HD_Range)
Z = Z_Coordinates(height, VD_Tree, HD_Range)

# Function to generate 3D points from the coordinate trees
def genPoints(x_tree, y_tree, z_tree):
    myPointTree = []
    count_1 = x_tree.BranchCount  # Number of branches
    count_2 = len(x_tree.Branch(0))  # Number of points in each branch

    for i in range(count_1):
        myTempList_X = x_tree.Branch(i)
        myTempList_Y = y_tree.Branch(i)
        myTempList_Z = z_tree.Branch(i)
        myPointList = []

        for k in range(count_2):
            myTempPoint = rg.Point3d(myTempList_X[k], myTempList_Y[k], myTempList_Z[k])
            myPointList.append(myTempPoint)

        myPointTree.append(myPointList)

    return gt.list_to_tree(myPointTree)

# Generate the final tree of points for the conical shape
conePoints = genPoints(X, Y, Z)
# ---------- end ghpython_script_2 ----------
ghpython_script_3 = GhPythonScript(
    V_Steps=number_of_vertical_divisions_4,
    H_Steps=number_of_horizontal_divisions_4,
    a=variable_a_2,
    b=variable_b_2,
    c=variable_c_2)  # -> X, Y, Z, Tree, myTree, graft(VD_Range), HD_Range, myPoints; inputs V_Steps: Int32, H_Steps: Int32, a: Int32, b: Int32, c: Int32
# ---------- ghpython_script_3: Python ----------
__author__ = "luye6"
__version__ = "2024.11.13"

import rhinoscriptsyntax as rs
import Rhino.Geometry as rg
import math
import ghpythonlib.treehelpers as gt


#rg.Interval()

#Vertical Divisions & Horizontal Divisions
VD = rs.CreateInterval(math.pi*-1, math.pi)
HD = rs.CreateInterval(0, math.pi*1/2)



# writing definition for calculating the range
def myRange(domain, steps):
    #start and end values of a domain
    start = domain[0]
    end = domain[1]
    
    #Calculate the step size
    step_size = (end-start)/ (steps)
    
    #Generate a range of values within the domain
    Values = []
    for i in range(0, steps+1):
        myValue = start + i*step_size
        Values.append(myValue)
    return Values

# Calculating the ranges for vertical and horizontal divisions
VD_Range= myRange(VD, V_Steps)
HD_Range= myRange(HD, H_Steps)

# Packing each single item in a individual list
def Graft(List):
    myTree = []
    for i in range(0, len(List)):
        myTempList = []
        for k in range(0,1):
            myTempList.append(List[i])
        myTree.append(myTempList)
    Tree = gt.list_to_tree(myTree)
    return Tree

Tree = Graft(VD_Range)

# u Tree (Grafted VD_Range)
# v List (HD_Range)
# a single item


def X_Coordinates (a,u,v):
    #The number of Branch
    myCount_Tree = u.BranchCount
    myCount_List = len(v)
    myTreeList = []
    for i in range(0, myCount_Tree):
        #the list in a branch
        myBranchList = u.Branch(i)
        myTempList = []
        for k in range(0, myCount_List):
            temp_X = a* math.cos(myBranchList[0])*math.sin(v[k])
            myTempList.append(temp_X)
        myTreeList.append(myTempList)
    return gt.list_to_tree(myTreeList)   

def Y_Coordinates (a,u,v):
    #The number of Branch
    myCount_Tree = u.BranchCount
    myCount_List = len(v)
    myTreeList = []
    for i in range(0, myCount_Tree):
        #the list in a branch
        myBranchList = u.Branch(i)
        myTempList = []
        for k in range(0, myCount_List):
            temp_Y = a* math.sin(myBranchList[0])*math.sin(v[k])
            myTempList.append(temp_Y)
        myTreeList.append(myTempList)
    return gt.list_to_tree(myTreeList)


def Z_Coordinates (a,u, v):
    #The number of Branch
    myCount_Tree = u.BranchCount
    myCount_List = len(v)
    myTreeList = []
    for i in range(0, myCount_Tree):
        #the list in a branch
        myBranchList = u.Branch(i)
        myTempList = []
        for k in range(0, myCount_List):
            temp_Z = a* math.cos(v[k])
            myTempList.append(temp_Z)
        myTreeList.append(myTempList)
    return gt.list_to_tree(myTreeList)

X = X_Coordinates(a, Tree, HD_Range)  
Y = Y_Coordinates(a, Tree, HD_Range)  
Z = Z_Coordinates(a, Tree, HD_Range)  


def genPoints(x_tree, y_tree, z_tree):
    myPointTree = [] 
    count_1 = x_tree.BranchCount 
    count_2 = len(x_tree.Branch(0)) 
    
    for i in range(0, count_1): 
        myTempList_X = x_tree.Branch(i)  
        myTempList_Y = y_tree.Branch(i) 
        myTempList_Z = z_tree.Branch(i) 
        myPointList = [] 
        
        for k in range(0, count_2): 
            myTempPoint = rg.Point3d(myTempList_X[k], myTempList_Y[k], myTempList_Z[k])
            myPointList.append(myTempPoint) 
            
        myPointTree.append(myPointList)  
    
    return gt.list_to_tree(myPointTree)  
    
myPoints = genPoints(X,Y,Z)
# ---------- end ghpython_script_3 ----------
ghpython_script_4 = GhPythonScript(V_Steps=number_of_vertical_divisions_3, H_Steps=number_of_horizontal_divisions_3, a=radius, b=height_2)  # -> X, Y, Z, Tree, myTree, VD_Range, HD_Range, cylinderPoints; inputs V_Steps: Int32, H_Steps: Int32, a: Int32, b: Int32, port: Int32
# ---------- ghpython_script_4: Python ----------
import rhinoscriptsyntax as rs
import Rhino.Geometry as rg
import math
import ghpythonlib.treehelpers as gt

# Define the interval for height (vertical range) and circular angle (horizontal range）定义范围
VD = rs.CreateInterval(0, 10)  # Height range 高度范围
HD = rs.CreateInterval(0, 2 * math.pi)  #  Full circle range 圆周范围

# Function to generate evenly spaced values within a given range 生成范围的等分值
def myRange(domain, steps):
    start = domain[0]
    end = domain[1]
    step_size = (end - start) / steps
    Values = [start + i * step_size for i in range(steps + 1)]
    return Values

# Function to convert a list into a Data Tree structure 将普通列表转换为树结构（Data Tree）
def Graft(List):
    myTree = []
    for i in range(len(List)):
        myTree.append([List[i]])  # Each item is placed in its own branch 每个元素单独放入一个列表
    return gt.list_to_tree(myTree)

# Generate vertical and horizontal ranges 生成垂直和水平分割范围
V_Steps = int(V_Steps) # Vertical divisions
H_Steps = int(H_Steps)  # Horizontal divisions

VD_Range = myRange(VD, V_Steps)
HD_Range = myRange(HD, H_Steps)

# Convert ranges to Data Tree structures 转换为树结构
VD_Tree = Graft(VD_Range)
HD_Tree = Graft(HD_Range)

# Function to calculate X coordinates for each point on the circular layers 计算 X 坐标
def X_Coordinates(radius, u, v):
    myTreeList = []
    for i in range(u.BranchCount):
        myBranchList = u.Branch(i)
        myTempList = []
        for k in range(len(v)):
            x = radius * math.cos(v[k])
            myTempList.append(x)
        myTreeList.append(myTempList)
    return gt.list_to_tree(myTreeList)

# Function to calculate Y coordinates for each point on the circular layers 计算 Y 坐标
def Y_Coordinates(radius, u, v):
    myTreeList = []
    for i in range(u.BranchCount):
        myBranchList = u.Branch(i)
        myTempList = []
        for k in range(len(v)):
            y = radius * math.sin(v[k])
            myTempList.append(y)
        myTreeList.append(myTempList)
    return gt.list_to_tree(myTreeList)

# Function to calculate Z coordinates for each point along the height 计算 Z 坐标
def Z_Coordinates(height, u, v):
    myTreeList = []
    for i in range(u.BranchCount):
        myBranchList = u.Branch(i)
        myTempList = []
        for k in range(len(v)):
            z = myBranchList[0] * height / u.Branch(u.BranchCount - 1)[0]  # Normalize Z coordinate to match the height
            myTempList.append(z)
        myTreeList.append(myTempList)
    return gt.list_to_tree(myTreeList)



# Input values for the radius and height of the shape 用函数生成点云
radius = float(a)
height = float(b)

# Generate X, Y, Z coordinate trees
X = X_Coordinates(radius, VD_Tree, HD_Range)
Y = Y_Coordinates(radius, VD_Tree, HD_Range)
Z = Z_Coordinates(height, VD_Tree, HD_Range)

# # Function to generate 3D points from the coordinate trees 生成点
def genPoints(x_tree, y_tree, z_tree):
    myPointTree = []
    count_1 = x_tree.BranchCount # Number of branches
    count_2 = len(x_tree.Branch(0)) # Number of points in each branch

    for i in range(count_1):
        myTempList_X = x_tree.Branch(i)
        myTempList_Y = y_tree.Branch(i)
        myTempList_Z = z_tree.Branch(i)
        myPointList = []

        for k in range(count_2):
            myTempPoint = rg.Point3d(myTempList_X[k], myTempList_Y[k], myTempList_Z[k])
            myPointList.append(myTempPoint)

        myPointTree.append(myPointList)

    return gt.list_to_tree(myPointTree)

# # Generate the final tree of points for the cylindrical shape 输出点云
cylinderPoints = genPoints(X, Y, Z)
# ---------- end ghpython_script_4 ----------
cull_index_2 = CullIndex(List=ghpython_script_2.conePoints, Indices=-1, Wrap=True)
flip_matrix = FlipMatrix(Data=cull_index_2)
ellipsoid_point_grid = Point(ghpython_script_3.myPoints)
ellipsoid_point_grid_2 = Point(flip_matrix)

# ----
# create section curves
panel_2 = Panel("0")
cull_index_3 = CullIndex(List=ellipsoid_point_grid_2, Indices=panel_2, Wrap=True)
flip_matrix_2 = FlipMatrix(Data=cull_index_3)
interpolate = Interpolate(Vertices=flip_matrix_2, Degree=3, Periodic=Toggle(True), KnotStyle=1)  # -> flatten(Curve), Length, Domain

# ----
# create section curves
flip_matrix_3 = FlipMatrix(Data=ellipsoid_point_grid_2)
interpolate_2 = Interpolate(Vertices=flip_matrix_3, Degree=3, Periodic=Toggle(True), KnotStyle=1)  # -> flatten(Curve), Length, Domain

expression_4 = Expression(x=number_of_horizontal_divisions_2, Expression="(x-1)/2")

# ----
# Facade
section_curves = Curve(interpolate.Curve)
section_curves_2 = Curve(interpolate_2.Curve)
beam_height_bottom = Slider(1, range=0..1)
beam_height_top = Slider(0.5, range=0..1)
data = Data(number_of_horizontal_divisions_2)
thickness = Slider(0.1, range=0..0.1)

list_item = ListItem(List=section_curves, Index="-1", Wrap=True)

# ----
# ring structure
number_slider = Slider(-3, range=-40..1)
unit_z = UnitZ(Factor=Slider(4, range=0..10))
offset_curve = OffsetCurve(Curve=list_item, Distance=number_slider, Corners=1)
curve = Curve(offset_curve)
move = Move(Geometry=curve, Motion=unit_z)  # -> flatten(Geometry), Transform
number_slider_2 = Slider(-2, range=-40..1)
offset_curve_2 = OffsetCurve(Curve=move.Geometry, Distance=number_slider_2, Corners=1)  # -> flatten(Curve)
unit_z_2 = UnitZ(Factor=Slider(2, range=0..10))
boundary_surfaces = BoundarySurfaces(Edges=[move.Geometry, offset_curve_2])
move_2 = Move(Geometry=offset_curve_2, Motion=unit_z_2)  # -> flatten(Geometry), Transform
offset_curve_3 = OffsetCurve(Curve=move_2.Geometry, Distance=number_slider_2, Corners=1)  # -> flatten(Curve)
boundary_surfaces_2 = BoundarySurfaces(Edges=[move_2.Geometry, offset_curve_3])
loft = Loft(
    Curves=[offset_curve_2, offset_curve_3],
    Options={Adjust=False, Closed=False, LoftEnds=0, LoftSimp=0, LoftType=0, Rebuild=10, Refit=0.01})
loft_2 = Loft(
    Curves=[move_2.Geometry, move.Geometry],
    Options={Adjust=False, Closed=False, LoftEnds=0, LoftSimp=0, LoftType=0, Rebuild=10, Refit=0.01})
brep_join = BrepJoin(Breps=[boundary_surfaces_2, loft_2, loft, boundary_surfaces])  # -> Breps, Closed

# ----
# roof line beam extrusion
panel_3 = Panel("-1")
list_item_2 = ListItem(List=section_curves, Index=panel_3, Wrap=True)
curve_2 = Curve(list_item_2)
divide_curve = DivideCurve(Curve=curve_2, Count=number_of_horizontal_divisions_2, Kinks=False)  # -> graft(Points), Tangents, Parameters
area = Area(Geometry=curve_2)  # -> Area, Centroid
line = Line(StartPoint=area.Centroid, EndPoint=divide_curve.Points)
curve_curve = CurveCurve(CurveA=line, CurveB=curve)  # -> Points, ParamsA, ParamsB
line_2 = Line(StartPoint=curve_curve.Points, EndPoint=divide_curve.Points)
unit_z_3 = UnitZ(Factor=-1)
move_3 = Move(Geometry=line_2, Motion=unit_z_3)  # -> Geometry, Transform
number_slider_3 = Slider(0.1, range=0..0.1)
loft_3 = Loft(
    Curves=[move_3.Geometry, line_2],
    Options={Adjust=False, Closed=False, LoftEnds=0, LoftSimp=0, LoftType=0, Rebuild=10, Refit=0.01})
boundary_surfaces_3 = BoundarySurfaces(Edges=loft_3)
planar = Planar(Curve=loft_3)  # -> Planar, Plane, Deviation
negative = Negative(Value=number_slider_3)
expression_5 = Expression(x=number_slider_3, Expression="2*x")
amplitude = Amplitude(Vector=planar.Plane, Amplitude=negative)
amplitude_2 = Amplitude(Vector=planar.Plane, Amplitude=expression_5)
move_4 = Move(Geometry=boundary_surfaces_3, Motion=amplitude)  # -> Geometry, Transform
extrude = Extrude(Base=move_4.Geometry, Direction=amplitude_2)

# ----
# roof ring beam
number_slider_4 = Slider(2, range=0..10)
list_item_3 = ListItem(List=section_curves_2, Index="-1", Wrap=True)
offset_curve_4 = OffsetCurve(Curve=list_item_3, Distance=number_slider_4, Corners=1)  # -> flatten(Curve)
loft_4 = Loft(
    Curves=[offset_curve_4, list_item_3],
    Options={Adjust=False, Closed=False, LoftEnds=0, LoftSimp=0, LoftType=0, Rebuild=10, Refit=0.01})
unit_z_4 = UnitZ(Factor=1)
extrude_2 = Extrude(Base=loft_4, Direction=unit_z_4)

# ----
# braces of the ring structure
unit_z_5 = UnitZ(Factor=0.5)
celling_opening = Data(curve)
data_2 = Data(offset_curve_2)
offset_curve_5 = OffsetCurve(Curve=celling_opening, Distance=Slider(-2, range=-2..100), Corners=1)
move_5 = Move(Geometry=celling_opening, Motion=unit_z_5)  # -> Geometry, Transform
loft_5 = Loft(
    Curves=flatten([celling_opening, offset_curve_5]),
    Options={Adjust=False, Closed=False, LoftEnds=0, LoftSimp=0, LoftType=0, Rebuild=10, Refit=0.01})
extrude_3 = Extrude(Base=loft_5, Direction=["0, 0, 0.5", "0, 0, -1"])
divide_curve_2 = DivideCurve(Curve=data_2, Count=data, Kinks=False)  # -> Points, Tangents, Parameters
divide_curve_3 = DivideCurve(Curve=move_5.Geometry, Count=data, Kinks=False)  # -> Points, Tangents, Parameters
cull_pattern = CullPattern(List=divide_curve_3.Points, CullPattern=[False, True, False, True])
cull_pattern_2 = CullPattern(List=divide_curve_2.Points, CullPattern=[True, False, True, False])
shift_list = ShiftList(List=cull_pattern_2, Shift=1, Wrap=True)
line_3 = Line(StartPoint=cull_pattern_2, EndPoint=cull_pattern)
line_4 = Line(StartPoint=cull_pattern, EndPoint=shift_list)
merge = Merge(Data1=line_3, Data2=line_4)
pipe = Pipe(Curve=merge, Radius=0.1, Caps=0)

# ----
# move points with variable distance inwards
points = Point(ellipsoid_point_grid_2)
loft_6 = Loft(Curves=section_curves, Options={Adjust=False, Closed=False, LoftEnds=0, LoftSimp=0, LoftType=0, Rebuild=10, Refit=0.01})
surface_closest_point = SurfaceClosestPoint(Point=points, Surface=loft_6)  # -> Point, UVPoint, Distance
evaluate_surface = EvaluateSurface(Surface=loft_6, Point=surface_closest_point.UVPoint)  # -> Point, Normal, UDirection, VDirection, Frame
list_length = ListLength(List=evaluate_surface.Normal)
construct_domain_3 = ConstructDomain(DomainStart=beam_height_top, DomainEnd=beam_height_bottom)
expression_6 = Expression(x=list_length, Expression="x-1")
range_3 = Range(Domain=construct_domain_3, Steps=expression_6)

expression_7 = Expression(x=range_3, Expression="-x")

amplitude_3 = Amplitude(Vector=evaluate_surface.Normal, Amplitude=expression_7)
move_6 = Move(Geometry=points, Motion=amplitude_3)  # -> Geometry, Transform
vector_display = VectorDisplay(Anchor=evaluate_surface.Point, Vector=amplitude_3)

# ----
# beam cross-section
reverse_list = ReverseList(List=move_6.Geometry)
trim_tree = TrimTree(Tree=reverse_list, Depth="1")
points_2 = Point(points)
merge_2 = Merge(Data1=trim_tree, Data2=points_2)
points_3 = Point(merge_2)
polyline = PolyLine(Vertices=points_3, Closed=True)

# ----
# beam extrusion
boundary_surfaces_4 = BoundarySurfaces(Edges=polyline)
planar_2 = Planar(Curve=polyline)  # -> Planar, Plane, Deviation
negative_2 = Negative(Value=thickness)
expression_8 = Expression(x=thickness, Expression="2*x")
amplitude_4 = Amplitude(Vector=planar_2.Plane, Amplitude=negative_2)
amplitude_5 = Amplitude(Vector=planar_2.Plane, Amplitude=expression_8)
move_7 = Move(Geometry=boundary_surfaces_4, Motion=amplitude_4)  # -> Geometry, Transform
extrude_4 = Extrude(Base=move_7.Geometry, Direction=amplitude_5)

# ----
# facade glass split
panel_4 = Panel("0")
number_slider_5 = Slider(1, range=0..1)
cull_index_4 = CullIndex(List=section_curves_2, Indices=panel_4, Wrap=True)
offset_curve_6 = OffsetCurve(Curve=cull_index_4, Distance=number_slider_5, Corners=1)
divide_curve_4 = DivideCurve(Curve=offset_curve_6, Count=data, Kinks=False)  # -> Points, Tangents, Parameters

# ----
# facade beam horizontal
divide_curve_5 = DivideCurve(Curve=section_curves_2, Count=number_of_horizontal_divisions_2, Kinks=False)  # -> Points, Tangents, Parameters
polyline_2 = PolyLine(Vertices=divide_curve_5.Points, Closed=True)  # -> flatten(Polyline)
cull_index_5 = CullIndex(List=polyline_2, Indices="-1", Wrap=True)
offset_curve_7 = OffsetCurve(Curve=cull_index_5, Distance=number_slider_5, Corners=1)
graft_tree = GraftTree(Tree=offset_curve_7, IncludeEmptyLists=True, IncludeNullItems=True)

# ----
# facade glass elements
offset_curve_8 = OffsetCurve(Curve=cull_index_5, Distance=number_slider_4, Corners=1)
divide_curve_6 = DivideCurve(Curve=offset_curve_6, Count=data, Kinks=False)  # -> Points, Tangents, Parameters
divide_curve_7 = DivideCurve(Curve=offset_curve_8, Count=data, Kinks=False)  # -> Points, Tangents, Parameters
polyline_3 = PolyLine(Vertices=divide_curve_6.Points, Closed=True)
polyline_4 = PolyLine(Vertices=divide_curve_7.Points, Closed=True)
explode = Explode(Curve=polyline_3, Recursive=True)  # -> graft(Segments), Vertices
explode_2 = Explode(Curve=polyline_4, Recursive=True)  # -> graft(Segments), Vertices
loft_7 = Loft(
    Curves=[explode_2.Segments, explode.Segments],
    Options={Adjust=False, Closed=False, LoftEnds=0, LoftSimp=0, LoftType=0, Rebuild=10, Refit=0.01})
evaluate_surface_2 = EvaluateSurface(Surface=loft_7, Point="0.5,0.5")  # -> Point, Normal, UDirection, VDirection, Frame
surface = Surface(loft_7)
amplitude_6 = Amplitude(Vector=evaluate_surface_2.Normal, Amplitude=Slider(0.02, range=0..0.1))
reverse = Reverse(Vector=amplitude_6)
extrude_5 = Extrude(Base=surface, Direction=reverse)

graft_tree_2 = GraftTree(Tree=offset_curve_8, IncludeEmptyLists=True, IncludeNullItems=True)
loft_8 = Loft(
    Curves=[graft_tree_2, graft_tree],
    Options={Adjust=False, Closed=False, LoftEnds=0, LoftSimp=0, LoftType=0, Rebuild=10, Refit=0.01})
extrude_6 = Extrude(Base=loft_8, Direction=["0, 0, 0.1", "0, 0, -0.1"])

divide_curve_8 = DivideCurve(Curve=offset_curve_8, Count=data, Kinks=False)  # -> Points, Tangents, Parameters
line_5 = Line(StartPoint=divide_curve_4.Points, EndPoint=divide_curve_8.Points)
pipe_2 = Pipe(Curve=line_5, Radius=0.1, Caps=0)

# ----
# ring structure
# facade beam
brep = Brep(brep_join.Breps)
# facade glass split
brep_2 = Brep(pipe_2)
# facade glass elements
brep_3 = Brep(extrude_5)
structural_support = Brep(extrude_4)
# roof ring beam
brep_4 = Brep([extrude_3, extrude_2])
# roof line beam extrusion
structural_support_2 = Brep(extrude)
# braces of the ring structure
brep_5 = Brep(pipe)

# ----
# facade beam horizontal
brep_6 = Brep(extrude_6)

# ----
# ramp
rebuild_count = Slider(200, range=0..1000)
bottom_d = Slider(36, range=0..100)
turns = Slider(3, range=0..3)
height_3 = Slider(12, range=0..20)
bottom_d_2 = Slider(24, range=0..100)
list_item_4 = ListItem(List=ellipsoid_point_grid_2, Index="0", Wrap=True)  # -> flatten(Item)
list_item_5 = ListItem(List=list_item_4, Index=0, Wrap=True)

expression_9 = Expression(x=bottom_d_2, Expression="x*(2/3)")
expression_10 = Expression(x=bottom_d, Expression="x*(2/3)")

out_spiralcurveg = SpiralCurveG(Plane=list_item_5, Radius1=bottom_d, Radius2=expression_10, Turns=turns, Height=height_3)
in_spiralcurveg = SpiralCurveG(Plane=list_item_5, Radius1=bottom_d_2, Radius2=expression_9, Turns=turns, Height=height_3)
rebuild_curve = RebuildCurve(Curve=out_spiralcurveg, Count=rebuild_count, Tangents=False)
rebuild_curve_2 = RebuildCurve(Curve=in_spiralcurveg, Count=rebuild_count, Tangents=False)
loft_9 = Loft(
    Curves=[rebuild_curve, rebuild_curve_2],
    Options={Adjust=False, Closed=False, LoftEnds=0, LoftSimp=0, LoftType=0, Rebuild=10, Refit=0.01})

# ----
# Spiral Staircase
# 1. visitor platform, ramps with braces and railing
# 2.  inner mirrored cone
# visitor platform
polyline_5 = PolyLine(Vertices=list_item_4, Closed=True)
polygon_center = PolygonCenter(Polyline=polyline_5)  # -> CenterV, CenterE, CenterA
expression_11 = Expression(x=turns, y=height_3, Expression="x*y")
unit_z_6 = UnitZ(Factor=expression_11)
number_slider_6 = Slider(10, range=0..100)
move_8 = Move(Geometry=polygon_center.CenterE, Motion=unit_z_6)  # -> Geometry, Transform
end_points = EndPoints(Curve=rebuild_curve)  # -> Start, End
point = Point(end_points.End)
circle = Circle(Plane=move_8.Geometry, Radius=number_slider_6)
move_9 = Move(Geometry=point, Motion=Vector(0, 0, 10))  # -> Geometry, Transform
offset_curve_9 = OffsetCurve(Curve=circle, Distance=number_slider_6, Corners=1)
line_6 = Line(StartPoint=move_9.Geometry, EndPoint=point)
brep_line = BrepLine(Brep=offset_curve_9, Line=line_6, LimitToFirst=False)  # -> Curves, Points
line_7 = Line(StartPoint=brep_line.Points, EndPoint=move_8.Geometry)
boundary_surfaces_5 = BoundarySurfaces(Edges=circle)
offset_curve_10 = OffsetCurve(Curve=circle, Distance=1.2, Corners=1)
circle_2 = Circle(Plane=move_8.Geometry, Radius=line_7)
rotate = Rotate(Geometry=line_7, Angle=0.6283185307, Plane=PlaneXY(0, 0, 0))  # -> Geometry, Transform
surface_split = SurfaceSplit(Surface=boundary_surfaces_5, Curves=[rotate.Geometry, line_7])
loft_10 = Loft(
    Curves=flatten([circle, circle_2]),
    Options={Adjust=False, Closed=False, LoftEnds=0, LoftSimp=0, LoftType=0, Rebuild=10, Refit=0.01})
explode_3 = Explode(Curve=surface_split, Recursive=True)  # -> flatten(Segments), Vertices
surface_split_2 = SurfaceSplit(Surface=loft_10, Curves=[rotate.Geometry, line_7])
cull_index_6 = CullIndex(List=surface_split_2, Indices=2, Wrap=True)
list_item_6 = ListItem(List=explode_3.Segments, Index=4, Wrap=True)
brep_edges = BrepEdges(Brep=cull_index_6)  # -> flatten(Naked), Interior, NonManifold
end_points_2 = EndPoints(Curve=list_item_6)  # -> Start, End
list_item_7 = ListItem(List=brep_edges.Naked, Index=1, Wrap=True)
list_item_8 = ListItem(List=brep_edges.Naked, Index=2, Wrap=True)
list_item_9 = ListItem(List=brep_edges.Naked, Index=7, Wrap=True)
end_points_3 = EndPoints(Curve=list_item_8)  # -> Start, End

# ----
# inner mirrored cone
number_slider_7 = Slider(50, range=0..100)
construct_domain_4 = ConstructDomain(DomainStart="0", DomainEnd=number_slider_7)
range_4 = Range(Domain=construct_domain_4, Steps=Slider(30, range=0..100))
graph_mapper = GraphMapper(
    range_4,
    x0=0,
    x1=100,
    y0=0,
    y1=1,
    container_name="Bezier",
    cpx=[0, 0.02967359126, 0.7166172266, 1],
    cpy=[0, 1, 0.991471231, 1])
unit_z_7 = UnitZ(Factor=range_4)
top_radius_2 = Slider(0.2, range=0..5)
reverse_2 = Reverse(Vector=unit_z_7)
bounds = Bounds(Numbers=graph_mapper)
construct_domain_5 = ConstructDomain(DomainStart=Slider(9, range=0..100), DomainEnd=top_radius_2)
move_10 = Move(Geometry=circle, Motion=reverse_2)  # -> Geometry, Transform
remap_numbers = RemapNumbers(Value=graph_mapper, Source=bounds, Target=construct_domain_5)  # -> Mapped, Clipped
circle_3 = Circle(Plane=move_10.Geometry, Radius=remap_numbers.Mapped)
cull_index_7 = CullIndex(List=circle_3, Indices="-1", Wrap=True)
cull_index_8 = CullIndex(List=circle_3, Indices="0", Wrap=True)
offset_curve_11 = OffsetCurve(Curve=cull_index_7, Distance=1, Corners=1)
curve_3 = Curve(graft(cull_index_8))
divide_curve_9 = DivideCurve(Curve=curve_3, Count=expression_4, Kinks=False)  # -> Points, Tangents, Parameters
divide_curve_10 = DivideCurve(Curve=offset_curve_11, Count=expression_4, Kinks=False)  # -> Points, Tangents, Parameters
polyline_6 = PolyLine(Vertices=divide_curve_10.Points, Closed=True)
polyline_7 = PolyLine(Vertices=divide_curve_9.Points, Closed=True)
trim_tree_2 = TrimTree(Tree=polyline_7, Depth=2)
trim_tree_3 = TrimTree(Tree=polyline_6, Depth=2)
loft_11 = Loft(
    Curves=[polyline_6, polyline_7],
    Options={Adjust=False, Closed=False, LoftEnds=0, LoftSimp=0, LoftType=0, Rebuild=10, Refit=0.01})
cull_index_9 = CullIndex(List=trim_tree_2, Indices="-1", Wrap=True)  # -> graft(List)
cull_index_10 = CullIndex(List=trim_tree_3, Indices="0", Wrap=True)  # -> graft(List)
loft_12 = Loft(
    Curves=[cull_index_10, cull_index_9],
    Options={Adjust=False, Closed=False, LoftEnds=0, LoftSimp=0, LoftType=0, Rebuild=10, Refit=0.01})

boundary_surfaces_6 = BoundarySurfaces(Edges=offset_curve_10)

# ----
# braces
data_3 = Data(ellipsoid_point_grid_2)
polyline_8 = PolyLine(Vertices=data_3, Closed=False)  # -> flatten(Polyline)
end_points_4 = EndPoints(Curve=polyline_8)  # -> Start, End
end_points_5 = EndPoints(Curve=polyline_8)  # -> Start, End
number_slider_8 = Slider(0.6, range=0..1)
vector_2pt = Vector2Pt(PointA=end_points_4.Start, PointB=end_points_4.End, Unitize=False)  # -> Vector, Length
vector_2pt_2 = Vector2Pt(PointA=end_points_5.Start, PointB=end_points_5.End, Unitize=False)  # -> Vector, Length
number_slider_9 = Slider(0.38, range=0..1)
expression_12 = Expression(x=number_slider_8, Expression="1/x")
visitor_platform_curve = Curve(boundary_surfaces_6)
scale_nu = ScaleNU(Geometry=polyline_8, Plane=PlaneXY(0, 0, 0), ScaleX=number_slider_8, ScaleY=number_slider_8, ScaleZ=1)  # -> flatten(Geometry), Transform
list_item_10 = ListItem(List=vector_2pt_2.Vector, Index=1, Wrap=True)
amplitude_7 = Amplitude(Vector=list_item_10, Amplitude=3)
brep_line_2 = BrepLine(Brep=loft_9, Line=scale_nu.Geometry, LimitToFirst=False)  # -> Curves, Points
list_item_11 = ListItem(List=data_3, Index=Slider(59, range=0..100), Wrap=True)
scale_nu_2 = ScaleNU(Geometry=polyline_8, Plane=PlaneXY(0, 0, 0), ScaleX=number_slider_9, ScaleY=number_slider_9, ScaleZ=1)  # -> Geometry, Transform
number_slider_10 = Slider(3, range=0..10)
number_slider_11 = Slider(-2, range=-10..10)
scale_nu_3 = ScaleNU(Geometry=brep_line_2.Points, Plane=PlaneXY(0, 0, 0), ScaleX=expression_12, ScaleY=expression_12, ScaleZ=1)  # -> Geometry, Transform
point_2 = Point(flatten(list_item_11))
brep_line_3 = BrepLine(Brep=visitor_platform_curve, Line=scale_nu_2.Geometry, LimitToFirst=False)  # -> Curves, flatten(Points)
list_item_12 = ListItem(List=vector_2pt.Vector, Index=3, Wrap=True)
list_item_13 = ListItem(List=vector_2pt.Vector, Index=1, Wrap=True)
list_item_14 = ListItem(List=vector_2pt.Vector, Index=17, Wrap=True)
list_item_15 = ListItem(List=vector_2pt.Vector, Index=15, Wrap=True)
list_item_16 = ListItem(List=vector_2pt.Vector, Index=5, Wrap=True)
list_item_17 = ListItem(List=vector_2pt.Vector, Index=4, Wrap=True)
list_item_18 = ListItem(List=vector_2pt.Vector, Index=13, Wrap=True)
list_item_19 = ListItem(List=vector_2pt.Vector, Index=11, Wrap=True)
list_item_20 = ListItem(List=vector_2pt.Vector, Index=0, Wrap=True)
list_item_21 = ListItem(List=vector_2pt.Vector, Index=2, Wrap=True)
list_item_22 = ListItem(List=vector_2pt.Vector, Index=6, Wrap=True)
list_item_23 = ListItem(List=vector_2pt.Vector, Index=9, Wrap=True)
list_item_24 = ListItem(List=vector_2pt.Vector, Index=7, Wrap=True)
list_item_25 = ListItem(List=vector_2pt.Vector, Index=8, Wrap=True)
list_item_26 = ListItem(List=vector_2pt.Vector, Index=10, Wrap=True)
list_item_27 = ListItem(List=vector_2pt.Vector, Index=12, Wrap=True)
list_item_28 = ListItem(List=vector_2pt.Vector, Index=14, Wrap=True)
list_item_29 = ListItem(List=vector_2pt.Vector, Index=16, Wrap=True)
list_item_30 = ListItem(List=vector_2pt.Vector, Index=18, Wrap=True)
curve_closest_point = CurveClosestPoint(Point=scale_nu_3.Geometry, Curve=rebuild_curve)  # -> Point, Parameter, Distance
list_item_31 = ListItem(List=vector_2pt.Vector, Index=3, Wrap=True)
list_item_32 = ListItem(List=vector_2pt.Vector, Index=1, Wrap=True)
list_item_33 = ListItem(List=vector_2pt.Vector, Index=17, Wrap=True)
list_item_34 = ListItem(List=vector_2pt.Vector, Index=15, Wrap=True)
list_item_35 = ListItem(List=vector_2pt.Vector, Index=5, Wrap=True)
list_item_36 = ListItem(List=vector_2pt.Vector, Index=4, Wrap=True)
list_item_37 = ListItem(List=vector_2pt.Vector, Index=13, Wrap=True)
list_item_38 = ListItem(List=vector_2pt.Vector, Index=11, Wrap=True)
list_item_39 = ListItem(List=vector_2pt.Vector, Index=0, Wrap=True)
list_item_40 = ListItem(List=vector_2pt.Vector, Index=2, Wrap=True)
list_item_41 = ListItem(List=vector_2pt.Vector, Index=6, Wrap=True)
list_item_42 = ListItem(List=vector_2pt.Vector, Index=9, Wrap=True)
list_item_43 = ListItem(List=vector_2pt.Vector, Index=7, Wrap=True)
list_item_44 = ListItem(List=vector_2pt.Vector, Index=8, Wrap=True)
list_item_45 = ListItem(List=vector_2pt.Vector, Index=10, Wrap=True)
list_item_46 = ListItem(List=vector_2pt.Vector, Index=12, Wrap=True)
list_item_47 = ListItem(List=vector_2pt.Vector, Index=14, Wrap=True)
list_item_48 = ListItem(List=vector_2pt.Vector, Index=16, Wrap=True)
list_item_49 = ListItem(List=vector_2pt.Vector, Index=18, Wrap=True)
cull_index_11 = CullIndex(List=point_2, Indices=Slider(1, range=0..10), Wrap=True)
cull_index_12 = CullIndex(List=brep_line_3.Points, Indices=Slider(1, range=0..10), Wrap=True)
amplitude_8 = Amplitude(Vector=list_item_14, Amplitude=number_slider_10)
amplitude_9 = Amplitude(Vector=list_item_13, Amplitude=number_slider_10)
amplitude_10 = Amplitude(Vector=list_item_15, Amplitude=number_slider_10)
amplitude_11 = Amplitude(Vector=list_item_12, Amplitude=number_slider_10)
amplitude_12 = Amplitude(Vector=list_item_16, Amplitude=number_slider_10)
amplitude_13 = Amplitude(Vector=list_item_17, Amplitude=number_slider_10)
amplitude_14 = Amplitude(Vector=list_item_18, Amplitude=number_slider_10)
amplitude_15 = Amplitude(Vector=list_item_19, Amplitude=number_slider_10)
amplitude_16 = Amplitude(Vector=list_item_20, Amplitude=number_slider_10)
amplitude_17 = Amplitude(Vector=list_item_21, Amplitude=number_slider_10)
amplitude_18 = Amplitude(Vector=list_item_22, Amplitude=number_slider_10)
amplitude_19 = Amplitude(Vector=list_item_23, Amplitude=number_slider_10)
amplitude_20 = Amplitude(Vector=list_item_24, Amplitude=number_slider_10)
amplitude_21 = Amplitude(Vector=list_item_25, Amplitude=number_slider_10)
amplitude_22 = Amplitude(Vector=list_item_26, Amplitude=number_slider_10)
amplitude_23 = Amplitude(Vector=list_item_27, Amplitude=number_slider_10)
amplitude_24 = Amplitude(Vector=list_item_28, Amplitude=number_slider_10)
amplitude_25 = Amplitude(Vector=list_item_29, Amplitude=number_slider_10)
amplitude_26 = Amplitude(Vector=list_item_30, Amplitude=number_slider_10)
flip_matrix_4 = FlipMatrix(Data=curve_closest_point.Point)  # -> flatten(Data)
amplitude_27 = Amplitude(Vector=list_item_33, Amplitude=number_slider_11)
amplitude_28 = Amplitude(Vector=list_item_32, Amplitude=number_slider_11)
amplitude_29 = Amplitude(Vector=list_item_34, Amplitude=number_slider_11)
amplitude_30 = Amplitude(Vector=list_item_31, Amplitude=number_slider_11)
amplitude_31 = Amplitude(Vector=list_item_35, Amplitude=number_slider_11)
flip_matrix_5 = FlipMatrix(Data=scale_nu_3.Geometry)  # -> flatten(Data)
amplitude_32 = Amplitude(Vector=list_item_36, Amplitude=number_slider_11)
amplitude_33 = Amplitude(Vector=list_item_37, Amplitude=number_slider_11)
amplitude_34 = Amplitude(Vector=list_item_38, Amplitude=number_slider_11)
amplitude_35 = Amplitude(Vector=list_item_39, Amplitude=number_slider_11)
amplitude_36 = Amplitude(Vector=list_item_40, Amplitude=number_slider_11)
amplitude_37 = Amplitude(Vector=list_item_41, Amplitude=number_slider_11)
amplitude_38 = Amplitude(Vector=list_item_42, Amplitude=number_slider_11)
amplitude_39 = Amplitude(Vector=list_item_43, Amplitude=number_slider_11)
amplitude_40 = Amplitude(Vector=list_item_44, Amplitude=number_slider_11)
amplitude_41 = Amplitude(Vector=list_item_45, Amplitude=number_slider_11)
cull_pattern_3 = CullPattern(List=cull_index_12, CullPattern=[False, True, False, True])
amplitude_42 = Amplitude(Vector=list_item_46, Amplitude=number_slider_11)
cull_pattern_4 = CullPattern(List=cull_index_11, CullPattern=[False, True, False, True])
amplitude_43 = Amplitude(Vector=list_item_47, Amplitude=number_slider_11)
amplitude_44 = Amplitude(Vector=list_item_48, Amplitude=number_slider_11)
amplitude_45 = Amplitude(Vector=list_item_49, Amplitude=number_slider_11)
cull_pattern_5 = CullPattern(List=flip_matrix_5, CullPattern=[False, True, False, True])
cull_pattern_6 = CullPattern(List=flip_matrix_4, CullPattern=[False, True, False, True])
line_8 = Line(StartPoint=cull_pattern_4, EndPoint=cull_pattern_3)
point_3 = Point(cull_pattern_5)
point_4 = Point(cull_pattern_5)
list_item_50 = ListItem(List=point_3, Index=[0, 19], Wrap=True)
point_5 = Point(cull_pattern_5)
list_item_51 = ListItem(List=point_4, Index=[8, 27], Wrap=True)
list_item_52 = ListItem(List=point_4, Index=[7, 26], Wrap=True)
list_item_53 = ListItem(List=point_4, Index=11, Wrap=True)
list_item_54 = ListItem(List=point_4, Index=[6, 25], Wrap=True)
list_item_55 = ListItem(List=point_4, Index=[5, 24], Wrap=True)
list_item_56 = ListItem(List=point_4, Index=9, Wrap=True)
list_item_57 = ListItem(List=point_4, Index=10, Wrap=True)
list_item_58 = ListItem(List=point_4, Index=12, Wrap=True)
list_item_59 = ListItem(List=point_4, Index=[4, 23], Wrap=True)
list_item_60 = ListItem(List=point_4, Index=[2, 21], Wrap=True)
list_item_61 = ListItem(List=point_4, Index=[3, 22], Wrap=True)
list_item_62 = ListItem(List=point_4, Index=[0, 19], Wrap=True)
list_item_63 = ListItem(List=point_4, Index=[1, 20], Wrap=True)
list_item_64 = ListItem(List=point_4, Index=13, Wrap=True)
list_item_65 = ListItem(List=point_4, Index=14, Wrap=True)
list_item_66 = ListItem(List=point_4, Index=15, Wrap=True)
list_item_67 = ListItem(List=point_4, Index=16, Wrap=True)
list_item_68 = ListItem(List=point_4, Index=17, Wrap=True)
list_item_69 = ListItem(List=point_4, Index=18, Wrap=True)
list_item_70 = ListItem(List=point_5, Index=[8, 27], Wrap=True)
list_item_71 = ListItem(List=point_5, Index=[7, 26], Wrap=True)
list_item_72 = ListItem(List=point_5, Index=11, Wrap=True)
list_item_73 = ListItem(List=point_5, Index=[6, 25], Wrap=True)
list_item_74 = ListItem(List=point_5, Index=[5, 24], Wrap=True)
list_item_75 = ListItem(List=point_5, Index=9, Wrap=True)
list_item_76 = ListItem(List=point_5, Index=10, Wrap=True)
list_item_77 = ListItem(List=point_5, Index=12, Wrap=True)
list_item_78 = ListItem(List=point_5, Index=[4, 23], Wrap=True)
list_item_79 = ListItem(List=point_5, Index=[2, 21], Wrap=True)
point_6 = Point(cull_pattern_6)
list_item_80 = ListItem(List=point_5, Index=[3, 22], Wrap=True)
list_item_81 = ListItem(List=point_5, Index=[0, 19], Wrap=True)
list_item_82 = ListItem(List=point_5, Index=[1, 20], Wrap=True)
list_item_83 = ListItem(List=point_5, Index=13, Wrap=True)
list_item_84 = ListItem(List=point_5, Index=14, Wrap=True)
list_item_85 = ListItem(List=point_5, Index=15, Wrap=True)
list_item_86 = ListItem(List=point_5, Index=16, Wrap=True)
list_item_87 = ListItem(List=point_5, Index=17, Wrap=True)
list_item_88 = ListItem(List=point_5, Index=18, Wrap=True)
move_11 = Move(Geometry=list_item_51, Motion=amplitude_8)  # -> Geometry, Transform
move_12 = Move(Geometry=list_item_52, Motion=amplitude_10)  # -> Geometry, Transform
move_13 = Move(Geometry=list_item_53, Motion=amplitude_13)  # -> Geometry, Transform
move_14 = Move(Geometry=list_item_56, Motion=amplitude_16)  # -> Geometry, Transform
move_15 = Move(Geometry=list_item_57, Motion=amplitude_17)  # -> Geometry, Transform
move_16 = Move(Geometry=list_item_58, Motion=amplitude_18)  # -> Geometry, Transform
move_17 = Move(Geometry=list_item_64, Motion=amplitude_21)  # -> Geometry, Transform
move_18 = Move(Geometry=list_item_65, Motion=amplitude_22)  # -> Geometry, Transform
move_19 = Move(Geometry=list_item_66, Motion=amplitude_23)  # -> Geometry, Transform
move_20 = Move(Geometry=list_item_54, Motion=amplitude_14)  # -> Geometry, Transform
move_21 = Move(Geometry=list_item_67, Motion=amplitude_24)  # -> Geometry, Transform
move_22 = Move(Geometry=list_item_55, Motion=amplitude_15)  # -> Geometry, Transform
move_23 = Move(Geometry=list_item_59, Motion=amplitude_19)  # -> Geometry, Transform
move_24 = Move(Geometry=list_item_68, Motion=amplitude_25)  # -> Geometry, Transform
move_25 = Move(Geometry=list_item_62, Motion=amplitude_9)  # -> Geometry, Transform
move_26 = Move(Geometry=list_item_63, Motion=amplitude_11)  # -> Geometry, Transform
move_27 = Move(Geometry=list_item_60, Motion=amplitude_12)  # -> Geometry, Transform
move_28 = Move(Geometry=list_item_61, Motion=amplitude_20)  # -> Geometry, Transform
move_29 = Move(Geometry=list_item_69, Motion=amplitude_26)  # -> Geometry, Transform
move_30 = Move(Geometry=list_item_70, Motion=amplitude_27)  # -> Geometry, Transform
move_31 = Move(Geometry=list_item_71, Motion=amplitude_29)  # -> Geometry, Transform
move_32 = Move(Geometry=list_item_72, Motion=amplitude_32)  # -> Geometry, Transform
move_33 = Move(Geometry=list_item_75, Motion=amplitude_35)  # -> Geometry, Transform
move_34 = Move(Geometry=list_item_76, Motion=amplitude_36)  # -> Geometry, Transform
move_35 = Move(Geometry=list_item_77, Motion=amplitude_37)  # -> Geometry, Transform
move_36 = Move(Geometry=list_item_83, Motion=amplitude_40)  # -> Geometry, Transform
move_37 = Move(Geometry=list_item_84, Motion=amplitude_41)  # -> Geometry, Transform
move_38 = Move(Geometry=list_item_85, Motion=amplitude_42)  # -> Geometry, Transform
move_39 = Move(Geometry=list_item_73, Motion=amplitude_33)  # -> Geometry, Transform
move_40 = Move(Geometry=list_item_86, Motion=amplitude_43)  # -> Geometry, Transform
move_41 = Move(Geometry=list_item_74, Motion=amplitude_34)  # -> Geometry, Transform
move_42 = Move(Geometry=list_item_78, Motion=amplitude_38)  # -> Geometry, Transform
move_43 = Move(Geometry=list_item_87, Motion=amplitude_44)  # -> Geometry, Transform
move_44 = Move(Geometry=list_item_81, Motion=amplitude_28)  # -> Geometry, Transform
move_45 = Move(Geometry=list_item_82, Motion=amplitude_30)  # -> Geometry, Transform
move_46 = Move(Geometry=list_item_79, Motion=amplitude_31)  # -> Geometry, Transform
move_47 = Move(Geometry=list_item_80, Motion=amplitude_39)  # -> Geometry, Transform
move_48 = Move(Geometry=list_item_88, Motion=amplitude_45)  # -> Geometry, Transform
list_item_89 = ListItem(List=point_6, Index=[8, 27], Wrap=True)
list_item_90 = ListItem(List=point_6, Index=[7, 26], Wrap=True)
list_item_91 = ListItem(List=point_6, Index=11, Wrap=True)
list_item_92 = ListItem(List=point_6, Index=[6, 25], Wrap=True)
list_item_93 = ListItem(List=point_6, Index=[5, 24], Wrap=True)
list_item_94 = ListItem(List=point_6, Index=9, Wrap=True)
list_item_95 = ListItem(List=point_6, Index=10, Wrap=True)
list_item_96 = ListItem(List=point_6, Index=12, Wrap=True)
list_item_97 = ListItem(List=point_6, Index=[4, 23], Wrap=True)
list_item_98 = ListItem(List=point_6, Index=[2, 21], Wrap=True)
list_item_99 = ListItem(List=point_6, Index=[3, 22], Wrap=True)
list_item_100 = ListItem(List=point_6, Index=[0, 19], Wrap=True)
list_item_101 = ListItem(List=point_6, Index=[1, 20], Wrap=True)
list_item_102 = ListItem(List=point_6, Index=13, Wrap=True)
list_item_103 = ListItem(List=point_6, Index=14, Wrap=True)
list_item_104 = ListItem(List=point_6, Index=15, Wrap=True)
list_item_105 = ListItem(List=point_6, Index=16, Wrap=True)
list_item_106 = ListItem(List=point_6, Index=17, Wrap=True)
list_item_107 = ListItem(List=point_6, Index=18, Wrap=True)
list_item_108 = ListItem(List=point_6, Index=[8, 27], Wrap=True)
list_item_109 = ListItem(List=point_6, Index=[7, 26], Wrap=True)
list_item_110 = ListItem(List=point_6, Index=11, Wrap=True)
list_item_111 = ListItem(List=point_6, Index=[6, 25], Wrap=True)
list_item_112 = ListItem(List=point_6, Index=[5, 24], Wrap=True)
list_item_113 = ListItem(List=point_6, Index=9, Wrap=True)
list_item_114 = ListItem(List=point_6, Index=10, Wrap=True)
list_item_115 = ListItem(List=point_6, Index=12, Wrap=True)
list_item_116 = ListItem(List=point_6, Index=[4, 23], Wrap=True)
list_item_117 = ListItem(List=point_6, Index=[2, 21], Wrap=True)
list_item_118 = ListItem(List=point_6, Index=[3, 22], Wrap=True)
list_item_119 = ListItem(List=point_6, Index=[0, 19], Wrap=True)
list_item_120 = ListItem(List=point_6, Index=[1, 20], Wrap=True)
list_item_121 = ListItem(List=point_6, Index=13, Wrap=True)
list_item_122 = ListItem(List=point_6, Index=14, Wrap=True)
list_item_123 = ListItem(List=point_6, Index=15, Wrap=True)
list_item_124 = ListItem(List=point_6, Index=16, Wrap=True)
list_item_125 = ListItem(List=point_6, Index=17, Wrap=True)
list_item_126 = ListItem(List=point_6, Index=18, Wrap=True)
line_9 = Line(StartPoint=list_item_100, EndPoint=move_25.Geometry)
line_10 = Line(StartPoint=list_item_101, EndPoint=move_26.Geometry)
line_11 = Line(StartPoint=list_item_98, EndPoint=move_27.Geometry)
line_12 = Line(StartPoint=list_item_99, EndPoint=move_28.Geometry)
line_13 = Line(StartPoint=list_item_97, EndPoint=move_23.Geometry)
line_14 = Line(StartPoint=list_item_93, EndPoint=move_22.Geometry)
line_15 = Line(StartPoint=list_item_92, EndPoint=move_20.Geometry)
line_16 = Line(StartPoint=list_item_90, EndPoint=move_12.Geometry)
line_17 = Line(StartPoint=list_item_89, EndPoint=move_11.Geometry)
line_18 = Line(StartPoint=list_item_94, EndPoint=move_14.Geometry)
line_19 = Line(StartPoint=list_item_95, EndPoint=move_15.Geometry)
line_20 = Line(StartPoint=list_item_91, EndPoint=move_13.Geometry)
line_21 = Line(StartPoint=list_item_96, EndPoint=move_16.Geometry)
line_22 = Line(StartPoint=list_item_102, EndPoint=move_17.Geometry)
line_23 = Line(StartPoint=list_item_103, EndPoint=move_18.Geometry)
line_24 = Line(StartPoint=list_item_104, EndPoint=move_19.Geometry)
line_25 = Line(StartPoint=list_item_105, EndPoint=move_21.Geometry)
line_26 = Line(StartPoint=list_item_106, EndPoint=move_24.Geometry)
line_27 = Line(StartPoint=list_item_107, EndPoint=move_29.Geometry)
line_28 = Line(StartPoint=list_item_119, EndPoint=move_44.Geometry)
line_29 = Line(StartPoint=list_item_120, EndPoint=move_45.Geometry)
line_30 = Line(StartPoint=list_item_117, EndPoint=move_46.Geometry)
line_31 = Line(StartPoint=list_item_118, EndPoint=move_47.Geometry)
line_32 = Line(StartPoint=list_item_116, EndPoint=move_42.Geometry)
line_33 = Line(StartPoint=list_item_112, EndPoint=move_41.Geometry)
line_34 = Line(StartPoint=list_item_111, EndPoint=move_39.Geometry)
line_35 = Line(StartPoint=list_item_109, EndPoint=move_31.Geometry)
line_36 = Line(StartPoint=list_item_108, EndPoint=move_30.Geometry)
line_37 = Line(StartPoint=list_item_113, EndPoint=move_33.Geometry)
line_38 = Line(StartPoint=list_item_114, EndPoint=move_34.Geometry)
line_39 = Line(StartPoint=list_item_110, EndPoint=move_32.Geometry)
line_40 = Line(StartPoint=list_item_115, EndPoint=move_35.Geometry)
line_41 = Line(StartPoint=list_item_121, EndPoint=move_36.Geometry)
line_42 = Line(StartPoint=list_item_122, EndPoint=move_37.Geometry)
line_43 = Line(StartPoint=list_item_123, EndPoint=move_38.Geometry)
line_44 = Line(StartPoint=list_item_124, EndPoint=move_40.Geometry)
line_45 = Line(StartPoint=list_item_125, EndPoint=move_43.Geometry)
line_46 = Line(StartPoint=list_item_126, EndPoint=move_48.Geometry)
merge_3 = Merge(
    Data1=line_9,
    Data2=line_10,
    Data3=line_11,
    Data4=line_12,
    Data5=line_13,
    Data6=line_14,
    Data7=line_15,
    Data8=line_16,
    Data9=line_17,
    Data10=line_18,
    Data11=line_19,
    Data12=line_20,
    Data13=line_21,
    Data14=line_22,
    Data15=line_23,
    Data16=line_24,
    Data17=line_25,
    Data18=line_26,
    Data19=line_27)
merge_4 = Merge(
    Data1=line_28,
    Data2=line_29,
    Data3=line_30,
    Data4=line_31,
    Data5=line_32,
    Data6=line_33,
    Data7=line_34,
    Data8=line_35,
    Data9=line_36,
    Data10=line_37,
    Data11=line_38,
    Data12=line_39,
    Data13=line_40,
    Data14=line_41,
    Data15=line_42,
    Data16=line_43,
    Data17=line_44,
    Data18=line_45,
    Data19=line_46)
pipe_3 = Pipe(Curve=[merge_3, line_8, merge_4], Radius=Slider(0.1, range=0..0.1), Caps=0)

# ----
# RAMP THICKNESS
unit_z_8 = UnitZ(Factor=-1)
extrude_7 = Extrude(Base=[loft_9, cull_index_6, boundary_surfaces_6], Direction=unit_z_8)

divide_curve_11 = DivideCurve(Curve=list_item_6, Count=20, Kinks=False)  # -> Points, Tangents, Parameters
polyline_9 = PolyLine(Vertices=divide_curve_11.Points, Closed=False)

curve_4 = Curve(polyline_9)
end_points_6 = EndPoints(Curve=curve_4)  # -> Start, End
line_47 = Line(StartPoint=end_points_6.Start, EndPoint=end_points_3.End)

# ----
# railing&glass
internal_spiralcurve = Curve(rebuild_curve_2)
out_spiralcurve = Curve(rebuild_curve)
end_points_7 = EndPoints(Curve=internal_spiralcurve)  # -> Start, End
line_48 = Line(StartPoint=end_points_2.End, EndPoint=end_points_7.End)
join_curves = JoinCurves(Curves=[list_item_8, list_item_7, list_item_9, line_48], Preserve=False)  # -> graft(Curves)
join_curves_2 = JoinCurves(Curves=[list_item_8, list_item_7, list_item_9, line_48, polyline_9], Preserve=False)  # -> graft(Curves)
unit_z_9 = UnitZ(Factor=Slider(3, range=0..10))
move_49 = Move(Geometry=internal_spiralcurve, Motion=unit_z_9)  # -> Geometry, Transform
move_50 = Move(Geometry=curve_4, Motion=unit_z_9)  # -> Geometry, Transform
move_51 = Move(Geometry=join_curves_2, Motion=unit_z_9)  # -> Geometry, Transform
move_52 = Move(Geometry=out_spiralcurve, Motion=unit_z_9)  # -> Geometry, Transform
move_53 = Move(Geometry=join_curves, Motion=unit_z_9)  # -> Geometry, Transform
loft_13 = Loft(
    Curves=[internal_spiralcurve, move_49.Geometry],
    Options={Adjust=False, Closed=False, LoftEnds=0, LoftSimp=0, LoftType=0, Rebuild=10, Refit=0.01})
loft_14 = Loft(
    Curves=[move_53.Geometry, join_curves],
    Options={Adjust=False, Closed=False, LoftEnds=0, LoftSimp=0, LoftType=0, Rebuild=10, Refit=0.01})
loft_15 = Loft(
    Curves=[move_50.Geometry, curve_4],
    Options={Adjust=False, Closed=False, LoftEnds=0, LoftSimp=0, LoftType=0, Rebuild=10, Refit=0.01})
loft_16 = Loft(
    Curves=[move_52.Geometry, out_spiralcurve],
    Options={Adjust=False, Closed=False, LoftEnds=0, LoftSimp=0, LoftType=0, Rebuild=10, Refit=0.01})

move_54 = Move(Geometry=line_47, Motion=unit_z_9)  # -> Geometry, Transform
loft_17 = Loft(
    Curves=[move_54.Geometry, line_47],
    Options={Adjust=False, Closed=False, LoftEnds=0, LoftSimp=0, LoftType=0, Rebuild=10, Refit=0.01})
weave = Weave(Pattern=[1, 0], Stream0=flatten(loft_12), Stream1=flatten(loft_11), NullGaps=False)

move_55 = Move(Geometry=weave, Motion=unit_z_8)  # -> Geometry, Transform

pipe_4 = Pipe(Curve=[move_52.Geometry, move_49.Geometry, move_51.Geometry, move_54.Geometry], Radius=0.1, Caps=0)
brep_7 = Brep(extrude_7)
merge_5 = Merge(Data1=loft_17, Data2=loft_14, Data3=loft_15, Data4=loft_16, Data5=loft_13)
geometry = Geometry(move_55.Geometry)
brep_8 = Brep(pipe_3)

# ----
# unfolding into 2D
deconstruct_brep = DeconstructBrep(Brep=geometry)  # -> Faces, Edges, Vertices
flip_matrix_6 = FlipMatrix(Data=deconstruct_brep.Faces)
unroll_brep = UnrollBrep(Brep=flip_matrix_6, JoinUnrolled=False)
bounding_box = BoundingBox(Content=unroll_brep, Plane=PlaneXY(0, 0, 0))  # -> Box, Box_2
deconstruct_box = DeconstructBox(Box=bounding_box.Box)  # -> Plane, XWidth, YLength, Z
deconstruct_domain = DeconstructDomain(Domain=deconstruct_box.XWidth)  # -> Start, End
deconstruct_domain_2 = DeconstructDomain(Domain=deconstruct_box.YLength)  # -> Start, End
horizontal_spacing = Slider(5, range=0..10)
vertical_spacing = Slider(21, range=0..100)
subtraction = Subtraction(A=deconstruct_domain.End, B=deconstruct_domain.Start)
subtraction_2 = Subtraction(A=deconstruct_domain_2.End, B=deconstruct_domain_2.Start)
addition = Addition(A=subtraction_2, B=vertical_spacing)

trim_tree_4 = TrimTree(Tree=subtraction_2, Depth=2)
trim_tree_5 = TrimTree(Tree=subtraction, Depth=2)
sort_list = SortList(Keys=trim_tree_4)  # -> reverse(Keys), ValuesValuesA
list_item_127 = ListItem(List=sort_list.Keys, Index=0, Wrap=True)
mass_addition = MassAddition(Input=flatten(list_item_127))  # -> Result, graft(PartialResults)
trim_tree_6 = TrimTree(Tree=unroll_brep, Depth=1)

addition_2 = Addition(A=trim_tree_5, B=horizontal_spacing)

mass_addition_2 = MassAddition(Input=addition_2)  # -> Result, PartialResults
vector_xyz = VectorXYZ(XComponent=mass_addition_2.PartialResults, YComponent=mass_addition.PartialResults, ZComponent=0)  # -> Vector, Length

move_56 = Move(Geometry=trim_tree_6, Motion=vector_xyz.Vector)  # -> Geometry, Transform

# ----
# number the elements
number_slider_12 = Slider(1, range=0..1)
area_2 = Area(Geometry=move_56.Geometry)  # -> Area, Centroid
list_length_2 = ListLength(List=flip_matrix_6)
series = Series(Start=number_slider_12, Step=Slider(1, range=0..1), Count=list_length_2)
text_tag_3d = TextTag3D(Location=area_2.Centroid, Text=series, Size=Slider(1, range=0..10), Justification=7)
