# Grasshopper definition 2024_WS_VPA_Final_LU_YE_cylinder.gh (Grasshopper 1.0.7)
# plug-ins: Bifocals, SpiralCurveG, LunchBox

number_of_horizontal_divisions = Slider(8, range=0..20)
number_of_vertical_divisions = Slider(18, range=0..40)
xy_plane = XYPlane(Origin=Point(0, 0, 0))
ghpython_script = GhPythonScript(x=xy_plane, y=Slider(5, range=0..10))  # -> out, myCircle, myCirclelist
# ---------- ghpython_script: Python ----------
__author__ = "luye6"
__version__ = "2024.11.13"

import rhinoscriptsyntax as rs
import Rhino.Geometry as rg

myPoint= rs.AddPoint(0,0,0)
myCirclelist = []

for i in range(0,10):
    myValue= 5 + 2*i
    myCircle= rs.AddCircle(myPoint, myValue)
    myCirclelist. append(myCircle)
    
a= myCirclelist
# ---------- end ghpython_script ----------
variable_a = Slider(10, range=0..10)
variable_b = Slider(10, range=0..10)
variable_c = Slider(13, range=-1..20)

# ----
# construct point grid of the ellipsoid
# 
# Replace with Phyton Components
panel = Panel("0")
construct_domain = ConstructDomain(DomainStart="-Pi", DomainEnd="Pi")
construct_domain_2 = ConstructDomain(DomainStart=panel, DomainEnd="Pi/2")
range = Range(Domain=construct_domain, Steps=number_of_vertical_divisions)
range_2 = Range(Domain=construct_domain_2, Steps=number_of_horizontal_divisions)
cull_index = CullIndex(List=range, Indices=0, Wrap=True)  # -> graft(List)
expression = Expression(a=variable_a, u=cull_index, v=range_2, Expression="( a * cos(u) * sin(v) )")
expression_2 = Expression(b=variable_b, u=cull_index, v=range_2, Expression="( b * sin(u) * sin(v) )")
expression_3 = Expression(c=variable_c, u=cull_index, v=range_2, Expression="( c * cos(v) )")
construct_point = ConstructPoint(XCoordinate=expression, YCoordinate=expression_2, ZCoordinate=expression_3)

number_of_horizontal_divisions_2 = Slider(8, range=0..20)
variable_b_2 = Slider(10, range=0..10)
variable_a_2 = Slider(10, range=0..10)
number_of_vertical_divisions_2 = Slider(18, range=0..40)
number_of_horizontal_divisions_3 = Slider(20, range=0..20)
variable_c_2 = Slider(10, range=-1..20)
base_radius = Slider(40, range=0..100)
number_of_vertical_divisions_3 = Slider(15, range=0..40)
top_radius = Slider(15, range=0..100)
height = Slider(60, range=0..100)
number_of_horizontal_divisions_4 = Slider(19, range=1..31)
number_of_vertical_divisions_4 = Slider(15, range=0..40)
radius = Slider(40, range=0..100)
height_2 = Slider(60, range=0..100)
ghpython_script_2 = GhPythonScript(
    V_Steps=number_of_vertical_divisions_2,
    H_Steps=number_of_horizontal_divisions_2,
    a=variable_a_2,
    b=variable_b_2,
    c=variable_c_2)  # -> X, Y, Z, Tree, myTree, graft(VD_Range), HD_Range, myPoints; inputs V_Steps: Int32, H_Steps: Int32, a: Int32, b: Int32, c: Int32
# ---------- ghpython_script_2: Python ----------
__author__ = "luye6"
__version__ = "2024.11.13"

import rhinoscriptsyntax as rs
import Rhino.Geometry as rg
import math
import ghpythonlib.treehelpers as gt


#rg.Interval()

#Vertical Divisions & Horizontal Divisions
VD = rs.CreateInterval(math.pi*-1, math.pi)
HD = rs.CreateInterval(0, math.pi*1/2)



# writing definition for calculating the range
def myRange(domain, steps):
    #start and end values of a domain
    start = domain[0]
    end = domain[1]
    
    #Calculate the step size
    step_size = (end-start)/ (steps)
    
    #Generate a range of values within the domain
    Values = []
    for i in range(0, steps+1):
        myValue = start + i*step_size
        Values.append(myValue)
    return Values

# Calculating the ranges for vertical and horizontal divisions
VD_Range= myRange(VD, V_Steps)
HD_Range= myRange(HD, H_Steps)

# Packing each single item in a individual list
def Graft(List):
    myTree = []
    for i in range(0, len(List)):
        myTempList = []
        for k in range(0,1):
            myTempList.append(List[i])
        myTree.append(myTempList)
    Tree = gt.list_to_tree(myTree)
    return Tree

Tree = Graft(VD_Range)

# u Tree (Grafted VD_Range)
# v List (HD_Range)
# a single item


def X_Coordinates (a,u,v):
    #The number of Branch
    myCount_Tree = u.BranchCount
    myCount_List = len(v)
    myTreeList = []
    for i in range(0, myCount_Tree):
        #the list in a branch
        myBranchList = u.Branch(i)
        myTempList = []
        for k in range(0, myCount_List):
            temp_X = a* math.cos(myBranchList[0])*math.sin(v[k])
            myTempList.append(temp_X)
        myTreeList.append(myTempList)
    return gt.list_to_tree(myTreeList)   

def Y_Coordinates (a,u,v):
    #The number of Branch
    myCount_Tree = u.BranchCount
    myCount_List = len(v)
    myTreeList = []
    for i in range(0, myCount_Tree):
        #the list in a branch
        myBranchList = u.Branch(i)
        myTempList = []
        for k in range(0, myCount_List):
            temp_Y = a* math.sin(myBranchList[0])*math.sin(v[k])
            myTempList.append(temp_Y)
        myTreeList.append(myTempList)
    return gt.list_to_tree(myTreeList)


def Z_Coordinates (a,u, v):
    #The number of Branch
    myCount_Tree = u.BranchCount
    myCount_List = len(v)
    myTreeList = []
    for i in range(0, myCount_Tree):
        #the list in a branch
        myBranchList = u.Branch(i)
        myTempList = []
        for k in range(0, myCount_List):
            temp_Z = a* math.cos(v[k])
            myTempList.append(temp_Z)
        myTreeList.append(myTempList)
    return gt.list_to_tree(myTreeList)

X = X_Coordinates(a, Tree, HD_Range)  
Y = Y_Coordinates(a, Tree, HD_Range)  
Z = Z_Coordinates(a, Tree, HD_Range)  


def genPoints(x_tree, y_tree, z_tree):
    myPointTree = [] 
    count_1 = x_tree.BranchCount 
    count_2 = len(x_tree.Branch(0)) 
    
    for i in range(0, count_1): 
        myTempList_X = x_tree.Branch(i)  
        myTempList_Y = y_tree.Branch(i) 
        myTempList_Z = z_tree.Branch(i) 
        myPointList = [] 
        
        for k in range(0, count_2): 
            myTempPoint = rg.Point3d(myTempList_X[k], myTempList_Y[k], myTempList_Z[k])
            myPointList.append(myTempPoint) 
            
        myPointTree.append(myPointList)  
    
    return gt.list_to_tree(myPointTree)  
    
myPoints = genPoints(X,Y,Z)
# ---------- end ghpython_script_2 ----------
ghpython_script_3 = GhPythonScript(V_Steps=number_of_vertical_divisions_4, H_Steps=number_of_horizontal_divisions_4, a=radius, b=height_2)  # -> X, Y, Z, Tree, myTree, VD_Range, HD_Range, cylinderPoints; inputs V_Steps: Int32, H_Steps: Int32, a: Int32, b: Int32, port: Int32
# ---------- ghpython_script_3: Python ----------
import rhinoscriptsyntax as rs
import Rhino.Geometry as rg
import math
import ghpythonlib.treehelpers as gt

# Define the interval for height (vertical range) and circular angle (horizontal range）定义范围
VD = rs.CreateInterval(0, 10)  # Height range 高度范围
HD = rs.CreateInterval(0, 2 * math.pi)  #  Full circle range 圆周范围

# Function to generate evenly spaced values within a given range 生成范围的等分值
def myRange(domain, steps):
    start = domain[0]
    end = domain[1]
    step_size = (end - start) / steps
    Values = [start + i * step_size for i in range(steps + 1)]
    return Values

# Function to convert a list into a Data Tree structure 将普通列表转换为树结构（Data Tree）
def Graft(List):
    myTree = []
    for i in range(len(List)):
        myTree.append([List[i]])  # Each item is placed in its own branch 每个元素单独放入一个列表
    return gt.list_to_tree(myTree)

# Generate vertical and horizontal ranges 生成垂直和水平分割范围
V_Steps = int(V_Steps) # Vertical divisions
H_Steps = int(H_Steps)  # Horizontal divisions

VD_Range = myRange(VD, V_Steps)
HD_Range = myRange(HD, H_Steps)

# Convert ranges to Data Tree structures 转换为树结构
VD_Tree = Graft(VD_Range)
HD_Tree = Graft(HD_Range)

# Function to calculate X coordinates for each point on the circular layers 计算 X 坐标
def X_Coordinates(radius, u, v):
    myTreeList = []
    for i in range(u.BranchCount):
        myBranchList = u.Branch(i)
        myTempList = []
        for k in range(len(v)):
            x = radius * math.cos(v[k])
            myTempList.append(x)
        myTreeList.append(myTempList)
    return gt.list_to_tree(myTreeList)

# Function to calculate Y coordinates for each point on the circular layers 计算 Y 坐标
def Y_Coordinates(radius, u, v):
    myTreeList = []
    for i in range(u.BranchCount):
        myBranchList = u.Branch(i)
        myTempList = []
        for k in range(len(v)):
            y = radius * math.sin(v[k])
            myTempList.append(y)
        myTreeList.append(myTempList)
    return gt.list_to_tree(myTreeList)

# Function to calculate Z coordinates for each point along the height 计算 Z 坐标
def Z_Coordinates(height, u, v):
    myTreeList = []
    for i in range(u.BranchCount):
        myBranchList = u.Branch(i)
        myTempList = []
        for k in range(len(v)):
            z = myBranchList[0] * height / u.Branch(u.BranchCount - 1)[0]  # Normalize Z coordinate to match the height
            myTempList.append(z)
        myTreeList.append(myTempList)
    return gt.list_to_tree(myTreeList)



# Input values for the radius and height of the shape 用函数生成点云
radius = float(a)
height = float(b)

# Generate X, Y, Z coordinate trees
X = X_Coordinates(radius, VD_Tree, HD_Range)
Y = Y_Coordinates(radius, VD_Tree, HD_Range)
Z = Z_Coordinates(height, VD_Tree, HD_Range)

# # Function to generate 3D points from the coordinate trees 生成点
def genPoints(x_tree, y_tree, z_tree):
    myPointTree = []
    count_1 = x_tree.BranchCount # Number of branches
    count_2 = len(x_tree.Branch(0)) # Number of points in each branch

    for i in range(count_1):
        myTempList_X = x_tree.Branch(i)
        myTempList_Y = y_tree.Branch(i)
        myTempList_Z = z_tree.Branch(i)
        myPointList = []

        for k in range(count_2):
            myTempPoint = rg.Point3d(myTempList_X[k], myTempList_Y[k], myTempList_Z[k])
            myPointList.append(myTempPoint)

        myPointTree.append(myPointList)

    return gt.list_to_tree(myPointTree)

# # Generate the final tree of points for the cylindrical shape 输出点云
cylinderPoints = genPoints(X, Y, Z)
# ---------- end ghpython_script_3 ----------
ghpython_script_4 = GhPythonScript(V_Steps=number_of_vertical_divisions_3, H_Steps=number_of_horizontal_divisions_3, a=base_radius, b=height, c=top_radius)  # -> X, Y, Z, Tree, myTree, VD_Range, HD_Range, conePoints; inputs V_Steps: Int32, H_Steps: Int32, a: Int32, b: Int32, c: Int32
# ---------- ghpython_script_4: Python ----------
import rhinoscriptsyntax as rs
import Rhino.Geometry as rg
import math
import ghpythonlib.treehelpers as gt

# Define the interval for height (vertical range) and circular angle (horizontal range)
VD = rs.CreateInterval(0, 10)  # Height range
HD = rs.CreateInterval(0, 2 * math.pi)  # Full circle range

# Function to generate evenly spaced values within a given range
def myRange(domain, steps):
    start = domain[0]
    end = domain[1]
    step_size = (end - start) / steps
    Values = [start + i * step_size for i in range(steps + 1)]
    return Values

# Function to convert a list into a Data Tree structure
def Graft(List):
    myTree = []
    for i in range(len(List)):
        myTree.append([List[i]])  # Each item is placed in its own branch
    return gt.list_to_tree(myTree)

# Generate vertical and horizontal ranges
V_Steps = int(V_Steps)  # Vertical divisions
H_Steps = int(H_Steps)  # Horizontal divisions

VD_Range = myRange(VD, V_Steps)
HD_Range = myRange(HD, H_Steps)

# Convert ranges to Data Tree structures
VD_Tree = Graft(VD_Range)
HD_Tree = Graft(HD_Range)

# Function to calculate X coordinates for each point on the circular layers
def X_Coordinates(base_radius, top_radius, u, v):
    myTreeList = []
    for i in range(u.BranchCount):
        myBranchList = u.Branch(i)
        current_radius = base_radius + (top_radius - base_radius) * (myBranchList[0] / VD[1])
        myTempList = []
        for k in range(len(v)):
            x = current_radius * math.cos(v[k])
            myTempList.append(x)
        myTreeList.append(myTempList)
    return gt.list_to_tree(myTreeList)

# Function to calculate Y coordinates for each point on the circular layers
def Y_Coordinates(base_radius, top_radius, u, v):
    myTreeList = []
    for i in range(u.BranchCount):
        myBranchList = u.Branch(i)
        current_radius = base_radius + (top_radius - base_radius) * (myBranchList[0] / VD[1])
        myTempList = []
        for k in range(len(v)):
            y = current_radius * math.sin(v[k])
            myTempList.append(y)
        myTreeList.append(myTempList)
    return gt.list_to_tree(myTreeList)

# Function to calculate Z coordinates for each point along the height
def Z_Coordinates(height, u, v):
    myTreeList = []
    for i in range(u.BranchCount):
        myBranchList = u.Branch(i)
        myTempList = []
        for k in range(len(v)):
            z = myBranchList[0] * height / u.Branch(u.BranchCount - 1)[0]  # Normalize Z coordinate
            myTempList.append(z)
        myTreeList.append(myTempList)
    return gt.list_to_tree(myTreeList)


# Input values for the base radius, top radius, and height of the cone
base_radius = float(a)
top_radius = float(c)
height = float(b)

# Generate X, Y, Z coordinate trees
X = X_Coordinates(base_radius, top_radius, VD_Tree, HD_Range)
Y = Y_Coordinates(base_radius, top_radius, VD_Tree, HD_Range)
Z = Z_Coordinates(height, VD_Tree, HD_Range)

# Function to generate 3D points from the coordinate trees
def genPoints(x_tree, y_tree, z_tree):
    myPointTree = []
    count_1 = x_tree.BranchCount  # Number of branches
    count_2 = len(x_tree.Branch(0))  # Number of points in each branch

    for i in range(count_1):
        myTempList_X = x_tree.Branch(i)
        myTempList_Y = y_tree.Branch(i)
        myTempList_Z = z_tree.Branch(i)
        myPointList = []

        for k in range(count_2):
            myTempPoint = rg.Point3d(myTempList_X[k], myTempList_Y[k], myTempList_Z[k])
            myPointList.append(myTempPoint)

        myPointTree.append(myPointList)

    return gt.list_to_tree(myPointTree)

# Generate the final tree of points for the conical shape
conePoints = genPoints(X, Y, Z)
# ---------- end ghpython_script_4 ----------
cull_index_2 = CullIndex(List=ghpython_script_3.cylinderPoints, Indices=-1, Wrap=True)
flip_matrix = FlipMatrix(Data=ghpython_script_4.conePoints)
flip_matrix_2 = FlipMatrix(Data=cull_index_2)
ellipsoid_point_grid = Point(ghpython_script_2.myPoints)
ellipsoid_point_grid_2 = Point(flip_matrix)
ellipsoid_point_grid_3 = Point(flip_matrix_2)

# ----
# create section curves
panel_2 = Panel("0")
cull_index_3 = CullIndex(List=ellipsoid_point_grid_3, Indices=panel_2, Wrap=True)
flip_matrix_3 = FlipMatrix(Data=cull_index_3)
interpolate = Interpolate(Vertices=flip_matrix_3, Degree=3, Periodic=Toggle(True), KnotStyle=1)  # -> flatten(Curve), Length, Domain

# ---- group: out
# ramp
panel_3 = Panel("0")
turns = Slider(4, range=0..10)
height_3 = Slider(12, range=0..15)
list_item = ListItem(List=ellipsoid_point_grid_3, Index=panel_3, Wrap=True)  # -> flatten(Item)
out_bottom_d = Slider(36, range=0..100)
out_top_d = Slider(36, range=0..100)
rebuild_count = Slider(200, range=0..1000)
in_bottom_d = Slider(24, range=0..100)
in_top_d = Slider(24, range=0..100)
list_item_2 = ListItem(List=list_item, Index=0, Wrap=True)
out_spiralcurveg = SpiralCurveG(Plane=list_item_2, Radius1=out_bottom_d, Radius2=out_top_d, Turns=turns, Height=height_3)
in_spiralcurveg = SpiralCurveG(Plane=list_item_2, Radius1=in_bottom_d, Radius2=in_top_d, Turns=turns, Height=height_3)
rebuild_curve = RebuildCurve(Curve=out_spiralcurveg, Count=rebuild_count, Tangents=False)
rebuild_curve_2 = RebuildCurve(Curve=in_spiralcurveg, Count=rebuild_count, Tangents=False)
unit_z = UnitZ(Factor=-1)
loft = Loft(
    Curves=[rebuild_curve, rebuild_curve_2],
    Options={Adjust=False, Closed=False, LoftEnds=0, LoftSimp=0, LoftType=0, Rebuild=10, Refit=0.01})
extrude = Extrude(Base=loft, Direction=unit_z)

# ----
# Facade
# create section curves
flip_matrix_4 = FlipMatrix(Data=ellipsoid_point_grid_3)
interpolate_2 = Interpolate(Vertices=flip_matrix_4, Degree=3, Periodic=Toggle(True), KnotStyle=1)  # -> flatten(Curve), Length, Domain

section_curves = Curve(interpolate.Curve)

points = Point(ellipsoid_point_grid_3)
loft_2 = Loft(Curves=section_curves, Options={Adjust=False, Closed=False, LoftEnds=0, LoftSimp=0, LoftType=0, Rebuild=10, Refit=0.01})
surface_closest_point = SurfaceClosestPoint(Point=points, Surface=loft_2)  # -> Point, UVPoint, Distance
evaluate_surface = EvaluateSurface(Surface=loft_2, Point=surface_closest_point.UVPoint)  # -> Point, Normal, UDirection, VDirection, Frame
beam_height_top = Slider(0.5, range=0..1)
beam_height_bottom = Slider(1, range=0..1)
list_length = ListLength(List=evaluate_surface.Normal)
expression_4 = Expression(x=list_length, Expression="x-1")
construct_domain_3 = ConstructDomain(DomainStart=beam_height_top, DomainEnd=beam_height_bottom)
range_3 = Range(Domain=construct_domain_3, Steps=expression_4)
expression_5 = Expression(x=range_3, Expression="-x")
amplitude = Amplitude(Vector=evaluate_surface.Normal, Amplitude=expression_5)
vector_display = VectorDisplay(Anchor=evaluate_surface.Point, Vector=amplitude)
move = Move(Geometry=points, Motion=amplitude)  # -> Geometry, Transform

spiralcurveg = Data(rebuild_curve)

# ----
# visitor platform
number_slider = Slider(18, range=0..100)
polyline = PolyLine(Vertices=list_item, Closed=True)
expression_6 = Expression(x=turns, y=height_3, Expression="x*y")
end_points = EndPoints(Curve=spiralcurveg)  # -> Start, End
polygon_center = PolygonCenter(Polyline=polyline)  # -> CenterV, CenterE, CenterA
unit_z_2 = UnitZ(Factor=expression_6)
move_2 = Move(Geometry=polygon_center.CenterE, Motion=unit_z_2)  # -> Geometry, Transform
point = Point(end_points.End)
circle = Circle(Plane=move_2.Geometry, Radius=number_slider)
move_3 = Move(Geometry=point, Motion=Vector(0, 0, 10))  # -> Geometry, Transform
boundary_surfaces = BoundarySurfaces(Edges=circle)
offset_curve = OffsetCurve(Curve=circle, Distance=number_slider, Corners=1)
line = Line(StartPoint=move_3.Geometry, EndPoint=point)
brep_line = BrepLine(Brep=offset_curve, Line=line, LimitToFirst=False)  # -> Curves, Points
line_2 = Line(StartPoint=brep_line.Points, EndPoint=move_2.Geometry)
offset_curve_2 = OffsetCurve(Curve=circle, Distance=1.2, Corners=1)
circle_2 = Circle(Plane=move_2.Geometry, Radius=line_2)
rotate = Rotate(Geometry=line_2, Angle=0.6283185307, Plane=PlaneXY(0, 0, 0))  # -> Geometry, Transform
surface_split = SurfaceSplit(Surface=boundary_surfaces, Curves=[rotate.Geometry, line_2])
boundary_surfaces_2 = BoundarySurfaces(Edges=offset_curve_2)
loft_3 = Loft(
    Curves=flatten([circle_2, offset_curve_2]),
    Options={Adjust=False, Closed=False, LoftEnds=0, LoftSimp=0, LoftType=0, Rebuild=10, Refit=0.01})
explode = Explode(Curve=surface_split, Recursive=True)  # -> flatten(Segments), Vertices
surface_split_2 = SurfaceSplit(Surface=loft_3, Curves=[rotate.Geometry, line_2])
unit_z_3 = UnitZ(Factor=-1)
list_item_3 = ListItem(List=explode.Segments, Index=4, Wrap=True)
cull_index_4 = CullIndex(List=surface_split_2, Indices=2, Wrap=True)
brep_edges = BrepEdges(Brep=cull_index_4)  # -> flatten(Naked), Interior, NonManifold
extrude_2 = Extrude(Base=[cull_index_4, boundary_surfaces_2], Direction=unit_z_3)
divide_curve = DivideCurve(Curve=list_item_3, Count=20, Kinks=False)  # -> Points, Tangents, Parameters
end_points_2 = EndPoints(Curve=list_item_3)  # -> Start, End
polyline_2 = PolyLine(Vertices=divide_curve.Points, Closed=False)
list_item_4 = ListItem(List=brep_edges.Naked, Index=2, Wrap=True)
list_item_5 = ListItem(List=brep_edges.Naked, Index=1, Wrap=True)
list_item_6 = ListItem(List=brep_edges.Naked, Index=7, Wrap=True)
curve = Curve(polyline_2)
end_points_3 = EndPoints(Curve=list_item_4)  # -> Start, End
end_points_4 = EndPoints(Curve=curve)  # -> Start, End
line_3 = Line(StartPoint=end_points_4.Start, EndPoint=end_points_3.End)

h_steps = Data(number_of_horizontal_divisions_4)

# ----
# roof line and ring beam
h_steps_2 = Data(number_of_horizontal_divisions_4)
section_curves_2 = Curve(interpolate.Curve)
list_item_7 = ListItem(List=section_curves_2, Index="-1", Wrap=True)
curve_2 = Curve(list_item_7)
divide_curve_2 = DivideCurve(Curve=curve_2, Count=h_steps_2, Kinks=False)  # -> graft(Points), Tangents, Parameters
area = Area(Geometry=curve_2)  # -> Area, Centroid
offset_curve_3 = OffsetCurve(Curve=list_item_7, Distance=Slider(-22, range=-40..1), Corners=1)
offset_curve_4 = OffsetCurve(Curve=list_item_7, Distance=Slider(2, range=0..10), Corners=1)  # -> flatten(Curve)
curve_3 = Curve(offset_curve_3)
line_4 = Line(StartPoint=area.Centroid, EndPoint=divide_curve_2.Points)
boundary_surfaces_3 = BoundarySurfaces(Edges=curve_2)
curve_curve = CurveCurve(CurveA=line_4, CurveB=curve_3)  # -> Points, ParamsA, ParamsB
boundary_surfaces_4 = BoundarySurfaces(Edges=curve_3)
loft_4 = Loft(
    Curves=[offset_curve_4, list_item_7],
    Options={Adjust=False, Closed=False, LoftEnds=0, LoftSimp=0, LoftType=0, Rebuild=10, Refit=0.01})
celling_opening = Data(curve_3)
line_5 = Line(StartPoint=curve_curve.Points, EndPoint=divide_curve_2.Points)
unit_z_4 = UnitZ(Factor=-1)
divide_curve_3 = DivideCurve(Curve=line_5, Count=Slider(3, range=0..10), Kinks=False)  # -> Points, Tangents, Parameters
move_4 = Move(Geometry=line_5, Motion=unit_z_4)  # -> Geometry, Transform
number_slider_2 = Slider(0.1, range=0..0.1)
loft_5 = Loft(
    Curves=[move_4.Geometry, line_5],
    Options={Adjust=False, Closed=False, LoftEnds=0, LoftSimp=0, LoftType=0, Rebuild=10, Refit=0.01})
solid_difference = SolidDifference(BrepsA=boundary_surfaces_3, BrepsB=boundary_surfaces_4)
list_item_8 = ListItem(List=divide_curve_3.Points, Index="1", Wrap=True)  # -> flatten(Item)
list_item_9 = ListItem(List=divide_curve_3.Points, Index="2", Wrap=True)  # -> flatten(Item)
boundary_surfaces_5 = BoundarySurfaces(Edges=loft_5)
planar = Planar(Curve=loft_5)  # -> Planar, Plane, Deviation
negative = Negative(Value=number_slider_2)
expression_7 = Expression(x=number_slider_2, Expression="2*x")
polyline_3 = PolyLine(Vertices=list_item_8, Closed=True)
polyline_4 = PolyLine(Vertices=list_item_9, Closed=True)
offset_curve_5 = OffsetCurve(Curve=celling_opening, Distance=Slider(-2, range=-2..100), Corners=1)
amplitude_2 = Amplitude(Vector=planar.Plane, Amplitude=negative)
amplitude_3 = Amplitude(Vector=planar.Plane, Amplitude=expression_7)
offset_curve_6 = OffsetCurve(Curve=polyline_3, Distance=Slider(0.1, range=-0.1..1), Corners=1)
offset_curve_7 = OffsetCurve(Curve=polyline_3, Distance=Slider(-0.1, range=-0.1..1), Corners=1)
offset_curve_8 = OffsetCurve(Curve=polyline_4, Distance=Slider(0.1, range=-0.1..1), Corners=1)
offset_curve_9 = OffsetCurve(Curve=polyline_4, Distance=Slider(-0.1, range=-0.1..1), Corners=1)
move_5 = Move(Geometry=boundary_surfaces_5, Motion=amplitude_2)  # -> Geometry, Transform
unit_z_5 = UnitZ(Factor=1)
loft_6 = Loft(
    Curves=flatten([celling_opening, offset_curve_5]),
    Options={Adjust=False, Closed=False, LoftEnds=0, LoftSimp=0, LoftType=0, Rebuild=10, Refit=0.01})
unit_z_6 = UnitZ(Factor=-1)
loft_7 = Loft(
    Curves=[offset_curve_7, offset_curve_6],
    Options={Adjust=False, Closed=False, LoftEnds=0, LoftSimp=0, LoftType=0, Rebuild=10, Refit=0.01})
loft_8 = Loft(
    Curves=[offset_curve_9, offset_curve_8],
    Options={Adjust=False, Closed=False, LoftEnds=0, LoftSimp=0, LoftType=0, Rebuild=10, Refit=0.01})
extrude_3 = Extrude(Base=move_5.Geometry, Direction=amplitude_3)
extrude_4 = Extrude(Base=loft_4, Direction=unit_z_5)
extrude_5 = Extrude(Base=loft_6, Direction=["0, 0, 0.5", "0, 0, -1"])
extrude_6 = Extrude(Base=[loft_7, loft_8], Direction=unit_z_6)

celling_opening_2 = Data(curve_3)

# ----
# ring structure
number_slider_3 = Slider(-2, range=-40..1)
unit_z_7 = UnitZ(Factor=Slider(4, range=0..10))
move_6 = Move(Geometry=celling_opening_2, Motion=unit_z_7)  # -> flatten(Geometry), Transform
offset_curve_10 = OffsetCurve(Curve=move_6.Geometry, Distance=number_slider_3, Corners=1)  # -> flatten(Curve)
unit_z_8 = UnitZ(Factor=Slider(2, range=0..10))
move_7 = Move(Geometry=offset_curve_10, Motion=unit_z_8)  # -> flatten(Geometry), Transform
boundary_surfaces_6 = BoundarySurfaces(Edges=[move_6.Geometry, offset_curve_10])
loft_9 = Loft(
    Curves=[move_7.Geometry, move_6.Geometry],
    Options={Adjust=False, Closed=False, LoftEnds=0, LoftSimp=0, LoftType=0, Rebuild=10, Refit=0.01})
offset_curve_11 = OffsetCurve(Curve=move_7.Geometry, Distance=number_slider_3, Corners=1)  # -> flatten(Curve)
boundary_surfaces_7 = BoundarySurfaces(Edges=[move_7.Geometry, offset_curve_11])
loft_10 = Loft(
    Curves=[offset_curve_10, offset_curve_11],
    Options={Adjust=False, Closed=False, LoftEnds=0, LoftSimp=0, LoftType=0, Rebuild=10, Refit=0.01})
brep_join = BrepJoin(Breps=[boundary_surfaces_7, loft_9, loft_10, boundary_surfaces_6])  # -> Breps, Closed

# ----
# braces of the ring structure
_0pening_curve_moved = Data(offset_curve_10)
unit_z_9 = UnitZ(Factor=0.5)
celling_opening_3 = Data(curve_3)
h_steps_3 = Data(number_of_horizontal_divisions_4)
move_8 = Move(Geometry=celling_opening_3, Motion=unit_z_9)  # -> Geometry, Transform
expression_8 = Expression(x=h_steps_3, Expression="X+1")
divide_curve_4 = DivideCurve(Curve=_0pening_curve_moved, Count=expression_8, Kinks=False)  # -> Points, Tangents, Parameters
divide_curve_5 = DivideCurve(Curve=move_8.Geometry, Count=expression_8, Kinks=False)  # -> Points, Tangents, Parameters
cull_pattern = CullPattern(List=divide_curve_5.Points, CullPattern=[False, True, False, True])
cull_pattern_2 = CullPattern(List=divide_curve_4.Points, CullPattern=[True, False, True, False])
shift_list = ShiftList(List=cull_pattern_2, Shift=1, Wrap=True)
line_6 = Line(StartPoint=cull_pattern_2, EndPoint=cull_pattern)
line_7 = Line(StartPoint=cull_pattern, EndPoint=shift_list)
merge = Merge(Data1=line_6, Data2=line_7)
pipe = Pipe(Curve=merge, Radius=0.1, Caps=0)

section_curves_3 = Curve(interpolate_2.Curve)
h_steps_4 = Data(number_of_horizontal_divisions_4)
divide_curve_6 = DivideCurve(Curve=section_curves_3, Count=h_steps_4, Kinks=False)  # -> Points, Tangents, Parameters
cull_index_5 = CullIndex(List=section_curves_3, Indices="0", Wrap=True)
polyline_5 = PolyLine(Vertices=divide_curve_6.Points, Closed=True)  # -> flatten(Polyline)
offset_curve_12 = OffsetCurve(Curve=cull_index_5, Distance=Slider(1, range=0..1), Corners=1)
cull_index_6 = CullIndex(List=polyline_5, Indices="-1", Wrap=True)
offset_curve_13 = OffsetCurve(Curve=cull_index_6, Distance=Slider(2, range=0..10), Corners=1)
divide_curve_7 = DivideCurve(Curve=offset_curve_12, Count=h_steps_4, Kinks=False)  # -> Points, Tangents, Parameters
divide_curve_8 = DivideCurve(Curve=offset_curve_12, Count=h_steps_4, Kinks=False)  # -> Points, Tangents, Parameters
divide_curve_9 = DivideCurve(Curve=offset_curve_13, Count=h_steps_4, Kinks=False)  # -> Points, Tangents, Parameters
divide_curve_10 = DivideCurve(Curve=offset_curve_13, Count=h_steps_3, Kinks=False)  # -> Points, Tangents, Parameters
polyline_6 = PolyLine(Vertices=divide_curve_7.Points, Closed=True)
line_8 = Line(StartPoint=divide_curve_8.Points, EndPoint=divide_curve_10.Points)
polyline_7 = PolyLine(Vertices=divide_curve_9.Points, Closed=True)
explode_2 = Explode(Curve=polyline_6, Recursive=True)  # -> graft(Segments), Vertices
explode_3 = Explode(Curve=polyline_7, Recursive=True)  # -> graft(Segments), Vertices
pipe_2 = Pipe(Curve=line_8, Radius=0.1, Caps=0)
loft_11 = Loft(
    Curves=[explode_3.Segments, explode_2.Segments],
    Options={Adjust=False, Closed=False, LoftEnds=0, LoftSimp=0, LoftType=0, Rebuild=10, Refit=0.01})
evaluate_surface_2 = EvaluateSurface(Surface=loft_11, Point="0.5,0.5")  # -> Point, Normal, UDirection, VDirection, Frame
surface = Surface(loft_11)
amplitude_4 = Amplitude(Vector=evaluate_surface_2.Normal, Amplitude=Slider(0.02, range=0..0.1))
reverse = Reverse(Vector=amplitude_4)
extrude_7 = Extrude(Base=surface, Direction=reverse)

number_slider_4 = Slider(0.46, range=0..1)
ramp = Brep(loft)

# ----
# move points with variable distance inwards
thickness = Slider(0.1, range=0..0.1)
reverse_list = ReverseList(List=move.Geometry)
points_2 = Point(points)
trim_tree = TrimTree(Tree=reverse_list, Depth="1")
merge_2 = Merge(Data1=trim_tree, Data2=points_2)
negative_2 = Negative(Value=thickness)
expression_9 = Expression(x=thickness, Expression="2*x")
polyline_8 = PolyLine(Vertices=merge_2, Closed=True)
planar_2 = Planar(Curve=polyline_8)  # -> Planar, Plane, Deviation
boundary_surfaces_8 = BoundarySurfaces(Edges=polyline_8)
amplitude_5 = Amplitude(Vector=planar_2.Plane, Amplitude=expression_9)
amplitude_6 = Amplitude(Vector=planar_2.Plane, Amplitude=negative_2)
move_9 = Move(Geometry=boundary_surfaces_8, Motion=amplitude_6)  # -> Geometry, Transform
extrude_8 = Extrude(Base=move_9.Geometry, Direction=amplitude_5)

expression_10 = Expression(x=number_of_horizontal_divisions_4, Expression="(x-1)/2")

# ----
# inner mirrored cone
number_slider_5 = Slider(70, range=0..100)
top_radius_2 = Slider(0.2, range=0.2..5)
construct_domain_4 = ConstructDomain(DomainStart="0", DomainEnd=number_slider_5)
range_4 = Range(Domain=construct_domain_4, Steps=Slider(30, range=0..100))
unit_z_10 = UnitZ(Factor=range_4)
graph_mapper = GraphMapper(range_4, x0=0, x1=100, y0=0, y1=1, container_name="Bezier", cpx=[0, 0.02967359126, 0.9094955325, 1], cpy=[0, 1, 1, 1])
reverse_2 = Reverse(Vector=unit_z_10)
construct_domain_5 = ConstructDomain(DomainStart=Slider(16, range=0..100), DomainEnd=top_radius_2)
bounds = Bounds(Numbers=graph_mapper)
move_10 = Move(Geometry=circle, Motion=reverse_2)  # -> Geometry, Transform
remap_numbers = RemapNumbers(Value=graph_mapper, Source=bounds, Target=construct_domain_5)  # -> Mapped, Clipped
circle_3 = Circle(Plane=move_10.Geometry, Radius=remap_numbers.Mapped)
cull_index_7 = CullIndex(List=circle_3, Indices="-1", Wrap=True)
cull_index_8 = CullIndex(List=circle_3, Indices="0", Wrap=True)
offset_curve_14 = OffsetCurve(Curve=cull_index_7, Distance=1, Corners=1)
curve_4 = Curve(graft(cull_index_8))
divide_curve_11 = DivideCurve(Curve=offset_curve_14, Count=expression_10, Kinks=False)  # -> Points, Tangents, Parameters
divide_curve_12 = DivideCurve(Curve=curve_4, Count=expression_10, Kinks=False)  # -> Points, Tangents, Parameters
polyline_9 = PolyLine(Vertices=divide_curve_11.Points, Closed=True)
polyline_10 = PolyLine(Vertices=divide_curve_12.Points, Closed=True)
trim_tree_2 = TrimTree(Tree=polyline_9, Depth=2)
trim_tree_3 = TrimTree(Tree=polyline_10, Depth=2)
cull_index_9 = CullIndex(List=trim_tree_2, Indices="0", Wrap=True)  # -> graft(List)
cull_index_10 = CullIndex(List=trim_tree_3, Indices="-1", Wrap=True)  # -> graft(List)
loft_12 = Loft(
    Curves=[polyline_9, polyline_10],
    Options={Adjust=False, Closed=False, LoftEnds=0, LoftSimp=0, LoftType=0, Rebuild=10, Refit=0.01})
loft_13 = Loft(
    Curves=[cull_index_9, cull_index_10],
    Options={Adjust=False, Closed=False, LoftEnds=0, LoftSimp=0, LoftType=0, Rebuild=10, Refit=0.01})

platform_entrance_edges = Data([list_item_4, list_item_5, list_item_6, line_3])
platform_entrance_edges_2 = Data([list_item_4, list_item_5, list_item_6, polyline_2, line_3])
platform_edges = Data(curve)

# ----
# railing&glass
internal_spiralcurve = Curve(rebuild_curve_2)
out_spiralcurve = Curve(rebuild_curve)
end_points_5 = EndPoints(Curve=internal_spiralcurve)  # -> Start, End
line_9 = Line(StartPoint=end_points_2.End, EndPoint=end_points_5.End)
join_curves = JoinCurves(Curves=[line_9, platform_entrance_edges], Preserve=False)  # -> graft(Curves)
join_curves_2 = JoinCurves(Curves=[platform_entrance_edges_2, line_9], Preserve=False)  # -> graft(Curves)
unit_z_11 = UnitZ(Factor=Slider(3, range=0..10))
move_11 = Move(Geometry=join_curves_2, Motion=unit_z_11)  # -> Geometry, Transform
move_12 = Move(Geometry=platform_edges, Motion=unit_z_11)  # -> Geometry, Transform
move_13 = Move(Geometry=join_curves, Motion=unit_z_11)  # -> Geometry, Transform
move_14 = Move(Geometry=out_spiralcurve, Motion=unit_z_11)  # -> Geometry, Transform
move_15 = Move(Geometry=internal_spiralcurve, Motion=unit_z_11)  # -> Geometry, Transform
loft_14 = Loft(
    Curves=[move_13.Geometry, join_curves],
    Options={Adjust=False, Closed=False, LoftEnds=0, LoftSimp=0, LoftType=0, Rebuild=10, Refit=0.01})
loft_15 = Loft(
    Curves=[platform_edges, move_12.Geometry],
    Options={Adjust=False, Closed=False, LoftEnds=0, LoftSimp=0, LoftType=0, Rebuild=10, Refit=0.01})
loft_16 = Loft(
    Curves=[internal_spiralcurve, move_15.Geometry],
    Options={Adjust=False, Closed=False, LoftEnds=0, LoftSimp=0, LoftType=0, Rebuild=10, Refit=0.01})
loft_17 = Loft(
    Curves=[move_14.Geometry, out_spiralcurve],
    Options={Adjust=False, Closed=False, LoftEnds=0, LoftSimp=0, LoftType=0, Rebuild=10, Refit=0.01})
pipe_3 = Pipe(Curve=[move_14.Geometry, move_15.Geometry, move_11.Geometry], Radius=0.1, Caps=0)

weave = Weave(Pattern=[1, 0], Stream0=flatten(loft_13), Stream1=flatten(loft_12), NullGaps=False)

move_16 = Move(Geometry=weave, Motion=unit_z_3)  # -> Geometry, Transform

# ----
# Interior Elements
# 1. visitor platform, ramps with braces and railing
# 2.  inner mirrored cone
merge_3 = Merge(Data2=loft_14, Data3=loft_15, Data4=loft_17, Data5=loft_16)

# ----
# unfolding into 2D
geometry = Geometry(move_16.Geometry)
deconstruct_brep = DeconstructBrep(Brep=geometry)  # -> Faces, Edges, Vertices
flip_matrix_5 = FlipMatrix(Data=deconstruct_brep.Faces)
unroll_brep = UnrollBrep(Brep=flip_matrix_5, JoinUnrolled=False)
list_length_2 = ListLength(List=flip_matrix_5)
trim_tree_4 = TrimTree(Tree=unroll_brep, Depth=1)
bounding_box = BoundingBox(Content=unroll_brep, Plane=PlaneXY(0, 0, 0))  # -> Box, Box_2
deconstruct_box = DeconstructBox(Box=bounding_box.Box)  # -> Plane, XWidth, YLength, Z
deconstruct_domain = DeconstructDomain(Domain=deconstruct_box.XWidth)  # -> Start, End
deconstruct_domain_2 = DeconstructDomain(Domain=deconstruct_box.YLength)  # -> Start, End
horizontal_spacing = Slider(5, range=0..10)
vertical_spacing = Slider(21, range=0..100)
subtraction = Subtraction(A=deconstruct_domain.End, B=deconstruct_domain.Start)
subtraction_2 = Subtraction(A=deconstruct_domain_2.End, B=deconstruct_domain_2.Start)
trim_tree_5 = TrimTree(Tree=subtraction, Depth=2)
trim_tree_6 = TrimTree(Tree=subtraction_2, Depth=2)
addition = Addition(A=subtraction_2, B=vertical_spacing)
addition_2 = Addition(A=trim_tree_5, B=horizontal_spacing)
sort_list = SortList(Keys=trim_tree_6)  # -> reverse(Keys), ValuesValuesA
list_item_10 = ListItem(List=sort_list.Keys, Index=0, Wrap=True)
mass_addition = MassAddition(Input=flatten(list_item_10))  # -> Result, graft(PartialResults)
mass_addition_2 = MassAddition(Input=addition_2)  # -> Result, PartialResults
vector_xyz = VectorXYZ(XComponent=mass_addition_2.PartialResults, YComponent=mass_addition.PartialResults, ZComponent=0)  # -> Vector, Length
move_17 = Move(Geometry=trim_tree_4, Motion=vector_xyz.Vector)  # -> Geometry, Transform
area_2 = Area(Geometry=move_17.Geometry)  # -> Area, Centroid
series = Series(Start=Slider(1, range=0..1), Step=Slider(1, range=0..1), Count=list_length_2)
text_tag_3d = TextTag3D(Location=area_2.Centroid, Text=series, Size=Slider(1, range=0..10), Justification=7)

section_curves_4 = Curve(interpolate_2.Curve)
divide_curve_13 = DivideCurve(Curve=section_curves_4, Count=number_of_horizontal_divisions_4, Kinks=False)  # -> Points, Tangents, Parameters
polyline_11 = PolyLine(Vertices=divide_curve_13.Points, Closed=True)  # -> flatten(Polyline)
cull_index_11 = CullIndex(List=polyline_11, Indices="-1", Wrap=True)
offset_curve_15 = OffsetCurve(Curve=cull_index_11, Distance=Slider(1, range=0..1), Corners=1)
graft_tree = GraftTree(Tree=offset_curve_15, IncludeEmptyLists=True, IncludeNullItems=True)

offset_curve_16 = OffsetCurve(Curve=cull_index_11, Distance=Slider(2, range=0..10), Corners=1)

graft_tree_2 = GraftTree(Tree=offset_curve_16, IncludeEmptyLists=True, IncludeNullItems=True)
loft_18 = Loft(
    Curves=[graft_tree_2, graft_tree],
    Options={Adjust=False, Closed=False, LoftEnds=0, LoftSimp=0, LoftType=0, Rebuild=10, Refit=0.01})
extrude_9 = Extrude(Base=loft_18, Direction=["0, 0, 0.1", "0, 0, -0.1"])

# ----
# facade beam vertical
structural_support = Brep(extrude_8)
# roof line beam
structural_support_2 = Brep(extrude_3)
# facade glass elements
brep = Brep(extrude_7)
# facade glass split
brep_2 = Brep(pipe_2)
# top ring structure
brep_3 = Brep(brep_join.Breps)
# braces of the top ring structure
brep_4 = Brep(pipe)
# facade beam horizontal
brep_5 = Brep(extrude_9)
# roof glass
surface_2 = Surface(solid_difference)
# roof ring beam
brep_6 = Brep([extrude_5, extrude_4])
# roof ring beam
brep_7 = Brep(extrude_6)

# ----
# braces
point_cloud = Data(ellipsoid_point_grid_3)
visitor_platform_curve = Curve(boundary_surfaces_2)
polyline_12 = PolyLine(Vertices=point_cloud, Closed=False)
scale_nu = ScaleNU(Geometry=polyline_12, Plane=PlaneXY(0, 0, 0), ScaleX=0.8, ScaleY=0.8, ScaleZ=1)  # -> flatten(Geometry), Transform
brep_line_2 = BrepLine(Brep=ramp, Line=scale_nu.Geometry, LimitToFirst=False)  # -> Curves, Points
scale_nu_2 = ScaleNU(Geometry=brep_line_2.Points, Plane=PlaneXY(0, 0, 0), ScaleX=1.25, ScaleY=1.25, ScaleZ=1)  # -> Geometry, Transform
flip_matrix_6 = FlipMatrix(Data=scale_nu_2.Geometry)  # -> flatten(Data)
curve_closest_point = CurveClosestPoint(Point=scale_nu_2.Geometry, Curve=rebuild_curve)  # -> Point, Parameter, Distance
unit_z_12 = UnitZ(Factor=-2)
cull_pattern_3 = CullPattern(List=flip_matrix_6, CullPattern=[False, True, False, True])
flip_matrix_7 = FlipMatrix(Data=curve_closest_point.Point)  # -> flatten(Data)
number_slider_6 = Slider(1.005, range=0..10)
cull_pattern_4 = CullPattern(List=flip_matrix_7, CullPattern=[False, True, False, True])
reverse_3 = Reverse(Vector=unit_z_12)
move_18 = Move(Geometry=cull_pattern_3, Motion=reverse_3)  # -> Geometry, Transform
move_19 = Move(Geometry=cull_pattern_3, Motion=unit_z_12)  # -> Geometry, Transform
scale_nu_3 = ScaleNU(Geometry=cull_pattern_4, Plane=PlaneXY(0, 0, 0), ScaleX=number_slider_6, ScaleY=number_slider_6, ScaleZ=1)  # -> Geometry, Transform
line_10 = Line(StartPoint=cull_pattern_4, EndPoint=move_19.Geometry)
line_11 = Line(StartPoint=scale_nu_3.Geometry, EndPoint=move_18.Geometry)

end_points_6 = EndPoints(Curve=polyline_12)  # -> Start, End
scale_nu_4 = ScaleNU(Geometry=polyline_12, Plane=PlaneXY(0, 0, 0), ScaleX=number_slider_4, ScaleY=number_slider_4, ScaleZ=1)  # -> Geometry, Transform
point_2 = Point(flatten(end_points_6.End))
brep_line_3 = BrepLine(Brep=visitor_platform_curve, Line=scale_nu_4.Geometry, LimitToFirst=False)  # -> Curves, flatten(Points)
cull_index_12 = CullIndex(List=point_2, Indices=Slider(1, range=0..10), Wrap=True)
cull_index_13 = CullIndex(List=brep_line_3.Points, Indices=Slider(1, range=0..10), Wrap=True)
cull_pattern_5 = CullPattern(List=cull_index_12, CullPattern=[False, True, False, True])
cull_pattern_6 = CullPattern(List=cull_index_13, CullPattern=[False, True, False, True])
line_12 = Line(StartPoint=cull_pattern_5, EndPoint=cull_pattern_6)

merge_4 = Merge(Data1=line_12, Data2=line_11, Data3=line_10)
pipe_4 = Pipe(Curve=merge_4, Radius=Slider(0.1, range=0..0.1), Caps=0)

# ----
# railing&glass
# inner mirrored cone
brep_8 = Brep(merge_3)
brep_9 = Brep(pipe_3)
# ramp
brep_10 = Brep(extrude)
geometry_2 = Geometry(move_16.Geometry)
# visitor platform
brep_11 = Brep(extrude_2)
# braces
brep_12 = Brep(pipe_4)
