# Grasshopper definition dome_pointcloud_examples.gh (Grasshopper 1.0.7)

number_of_vertical_divisions = Slider(8, range=0..40)
number_of_horizontal_divisions = Slider(15, range=1..21)
base_radius = Slider(44, range=0..100)
dome_height = Slider(42.3, range=0..100)
xy = XYPlane(Origin=Point(0, 0, 0))
number_of_vertical_divisions_2 = Slider(18, range=0..40)
number_of_horizontal_divisions_2 = Slider(20, range=1..21)
base_radius_2 = Slider(28.4, range=0..100)
dome_height_2 = Slider(27.5, range=0..100)
xy_2 = XYPlane(Origin=Point(0, 0, 0))
a_param = Slider(74.4, range=0..100)
number_of_vertical_divisions_3 = Slider(15, range=0..40)
number_of_horizontal_divisions_3 = Slider(19, range=1..21)
base_radius_3 = Slider(40, range=0..100)
height = Slider(60, range=0..100)
top_radius = Slider(15, range=0..100)
spherical_dome = GhPythonScript(
    V_Steps=number_of_vertical_divisions,
    H_Steps=number_of_horizontal_divisions,
    base_radius=base_radius,
    dome_height=dome_height,
    base_plane=xy)  # -> points_world; inputs V_Steps: Int32, H_Steps: Int32, base_radius: Int32, dome_height: Int32, base_plane: Plane
# ---------- spherical_dome: Python ----------
import rhinoscriptsyntax as rs
import Rhino.Geometry as rg
import ghpythonlib.treehelpers as gt
import math

# -------------------------------
# Input parameters from Grasshopper:
# dome_height: float – height of the dome
# base_radius: float – base radius of the dome
# V_Steps: int – vertical subdivisions (latitude)
# H_Steps: int – horizontal subdivisions (longitude)
# base_plane: Plane – base placement of the dome
# -------------------------------

# Generate evenly spaced range within a domain
def myRange(domain, steps):
    start = domain[0]
    end = domain[1]
    if steps <= 0:
        return [start]
    step_size = (end - start) / float(steps)
    return [start + i * step_size for i in range(steps + 1)]

# Wrap a list as a grafted data tree
def Graft(lst):
    return gt.list_to_tree([[item] for item in lst])

# Generate spherical coordinates from theta/phi angles
def SphericalCoords(R, theta_tree, phi_list):
    X_tree, Y_tree, Z_tree = [], [], []
    for i in range(theta_tree.BranchCount):
        theta = theta_tree.Branch(i)[0]
        xs, ys, zs = [], [], []
        for phi in phi_list:
            x = R * math.sin(phi) * math.cos(theta)
            y = R * math.sin(phi) * math.sin(theta)
            z = R * math.cos(phi)
            xs.append(x)
            ys.append(y)
            zs.append(z)
        X_tree.append(xs)
        Y_tree.append(ys)
        Z_tree.append(zs)
    return gt.list_to_tree(X_tree), gt.list_to_tree(Y_tree), gt.list_to_tree(Z_tree)

# Combine X, Y, Z trees into a tree of Point3d
def CombineXYZ(X_tree, Y_tree, Z_tree):
    pointTree = []
    for i in range(X_tree.BranchCount):
        xs = X_tree.Branch(i)
        ys = Y_tree.Branch(i)
        zs = Z_tree.Branch(i)
        branch = [rg.Point3d(xs[j], ys[j], zs[j]) for j in range(len(xs))]
        pointTree.append(branch)
    return gt.list_to_tree(pointTree)

# -------------------------------
# Main execution
# -------------------------------

# Validate inputs
if dome_height <= 0 or base_radius <= 0 or V_Steps <= 0 or H_Steps <= 0:
    raise Exception("❌ All input values must be positive and non-zero.")

# Calculate full sphere radius and Z-offset from dome base to sphere center
R = (base_radius**2 + dome_height**2) / (2 * dome_height)
z_offset = R - dome_height

# Construct angle domains (theta: full circle, phi: limited to dome height)
theta_domain = rs.CreateInterval(0, 2 * math.pi)
phi_max = math.acos((R - dome_height) / R)
phi_domain = rs.CreateInterval(0, phi_max)

theta_range = myRange(theta_domain, H_Steps)
phi_range = myRange(phi_domain, V_Steps)

theta_tree = Graft(theta_range)

# Compute X, Y, Z coordinate trees
X, Y, Z = SphericalCoords(R, theta_tree, phi_range)
points_local = CombineXYZ(X, Y, Z)

# Transform local points to world coordinates using base_plane and offset
if points_local and points_local.BranchCount > 0:
    points_world = gt.list_to_tree([
        [base_plane.PointAt(pt.X, pt.Y, pt.Z - z_offset) for pt in branch]
        for branch in points_local.Branches
    ])
else:
    print("⚠️ No valid point branches generated.")
    points_world = None
# ---------- end spherical_dome ----------
catenary_dome = GhPythonScript(
    V_Steps=number_of_vertical_divisions_2,
    H_Steps=number_of_horizontal_divisions_2,
    base_radius=base_radius_2,
    dome_height=dome_height_2,
    base_plane=xy_2,
    a_param=a_param)  # -> points_world; inputs V_Steps: Int32, H_Steps: Int32, base_radius: Int32, dome_height: Int32, base_plane: Plane
# ---------- catenary_dome: Python ----------
import rhinoscriptsyntax as rs
import Rhino.Geometry as rg
import ghpythonlib.treehelpers as gt
import math

# ------------------------------------------
# Input parameters from Grasshopper:
# base_radius: float – half-span of the dome
# dome_height: float – total height of the dome
# a_param: float – catenary curve steepness parameter (a in y = a·cosh(x/a))
# V_Steps: int – number of points along the curve
# H_Steps: int – number of rotation steps
# base_plane: Plane – dome placement plane
# ------------------------------------------

# Generate evenly spaced values
def myRange(start, end, steps):
    if steps <= 0:
        return [start]
    step_size = (end - start) / float(steps)
    return [start + i * step_size for i in range(steps + 1)]

# Generate 2D catenary profile in XZ plane (curve is symmetric)
def CatenaryProfilePoints(a, base_r, height, steps):
    x_start = -base_r
    x_end = base_r
    raw_pts = []

    for i in range(steps + 1):
        t = float(i) / steps
        x = x_start + t * (x_end - x_start)
        y = a * math.cosh(x / a)
        raw_pts.append(rg.Point3d(x, y, 0))

    # Normalize vertically to height
    y_min = min(p.Y for p in raw_pts)
    y_max = max(p.Y for p in raw_pts)
    raw_height = y_max - y_min
    if raw_height == 0:
        raw_height = 1.0

    scale = height / raw_height

    points = []
    for p in raw_pts:
        r = abs(p.X)
        z = height - (p.Y - y_min) * scale  # Flip upwards
        points.append(rg.Point3d(r, 0, z))

    return points

# Rotate profile around Z-axis
def RevolvePoints(profile_pts, steps, plane):
    angle_max = 2 * math.pi
    pts_tree = []

    for i in range(steps + 1):
        angle = (float(i) / steps) * angle_max
        rot = rg.Transform.Rotation(angle, plane.ZAxis, plane.Origin)
        branch = []
        for pt in profile_pts:
            pt_rotated = rg.Point3d(pt)
            pt_rotated.Transform(rot)
            pt_world = plane.PointAt(pt_rotated.X, pt_rotated.Y, pt_rotated.Z)
            branch.append(pt_world)
        pts_tree.append(branch)

    return gt.list_to_tree(pts_tree)

# ------------------------------------------
# Main execution
# ------------------------------------------

# Validate inputs
if dome_height <= 0 or base_radius <= 0 or a_param <= 0 or V_Steps <= 0 or H_Steps <= 0:
    raise Exception("❌ All input values must be positive and non-zero.")

# Generate profile curve and revolve to get 3D points
profile = CatenaryProfilePoints(a_param, base_radius, dome_height, V_Steps)
points_world = RevolvePoints(profile, H_Steps, base_plane)
# ---------- end catenary_dome ----------
cone_dome = GhPythonScript(
    V_Steps=number_of_vertical_divisions_3,
    H_Steps=number_of_horizontal_divisions_3,
    a=base_radius_3,
    b=height,
    c=top_radius)  # -> conePoints; inputs V_Steps: Int32, H_Steps: Int32, a: Int32, b: Int32, c: Int32
# ---------- cone_dome: Python ----------
import rhinoscriptsyntax as rs
import Rhino.Geometry as rg
import math
import ghpythonlib.treehelpers as gt

# Define the interval for height (vertical range) and circular angle (horizontal range)
VD = rs.CreateInterval(0, 10)  # Height range
HD = rs.CreateInterval(0, 2 * math.pi)  # Full circle range

# Function to generate evenly spaced values within a given range
def myRange(domain, steps):
    start = domain[0]
    end = domain[1]
    step_size = (end - start) / steps
    Values = [start + i * step_size for i in range(steps + 1)]
    return Values

# Function to convert a list into a Data Tree structure
def Graft(List):
    myTree = []
    for i in range(len(List)):
        myTree.append([List[i]])  # Each item is placed in its own branch
    return gt.list_to_tree(myTree)

# Generate vertical and horizontal ranges
V_Steps = int(V_Steps)  # Vertical divisions
H_Steps = int(H_Steps)  # Horizontal divisions

VD_Range = myRange(VD, V_Steps)
HD_Range = myRange(HD, H_Steps)

# Convert ranges to Data Tree structures
VD_Tree = Graft(VD_Range)
HD_Tree = Graft(HD_Range)

# Function to calculate X coordinates for each point on the circular layers
def X_Coordinates(base_radius, top_radius, u, v):
    myTreeList = []
    for i in range(u.BranchCount):
        myBranchList = u.Branch(i)
        current_radius = base_radius + (top_radius - base_radius) * (myBranchList[0] / VD[1])
        myTempList = []
        for k in range(len(v)):
            x = current_radius * math.cos(v[k])
            myTempList.append(x)
        myTreeList.append(myTempList)
    return gt.list_to_tree(myTreeList)

# Function to calculate Y coordinates for each point on the circular layers
def Y_Coordinates(base_radius, top_radius, u, v):
    myTreeList = []
    for i in range(u.BranchCount):
        myBranchList = u.Branch(i)
        current_radius = base_radius + (top_radius - base_radius) * (myBranchList[0] / VD[1])
        myTempList = []
        for k in range(len(v)):
            y = current_radius * math.sin(v[k])
            myTempList.append(y)
        myTreeList.append(myTempList)
    return gt.list_to_tree(myTreeList)

# Function to calculate Z coordinates for each point along the height
def Z_Coordinates(height, u, v):
    myTreeList = []
    for i in range(u.BranchCount):
        myBranchList = u.Branch(i)
        myTempList = []
        for k in range(len(v)):
            z = myBranchList[0] * height / u.Branch(u.BranchCount - 1)[0]  # Normalize Z coordinate
            myTempList.append(z)
        myTreeList.append(myTempList)
    return gt.list_to_tree(myTreeList)


# Input values for the base radius, top radius, and height of the cone
base_radius = float(a)
top_radius = float(c)
height = float(b)

# Generate X, Y, Z coordinate trees
X = X_Coordinates(base_radius, top_radius, VD_Tree, HD_Range)
Y = Y_Coordinates(base_radius, top_radius, VD_Tree, HD_Range)
Z = Z_Coordinates(height, VD_Tree, HD_Range)

# Function to generate 3D points from the coordinate trees
def genPoints(x_tree, y_tree, z_tree):
    myPointTree = []
    count_1 = x_tree.BranchCount  # Number of branches
    count_2 = len(x_tree.Branch(0))  # Number of points in each branch

    for i in range(count_1):
        myTempList_X = x_tree.Branch(i)
        myTempList_Y = y_tree.Branch(i)
        myTempList_Z = z_tree.Branch(i)
        myPointList = []

        for k in range(count_2):
            myTempPoint = rg.Point3d(myTempList_X[k], myTempList_Y[k], myTempList_Z[k])
            myPointList.append(myTempPoint)

        myPointTree.append(myPointList)

    return gt.list_to_tree(myPointTree)

# Generate the final tree of points for the conical shape
conePoints = genPoints(X, Y, Z)
# ---------- end cone_dome ----------
pt = Point(spherical_dome)
pt_2 = Point(catenary_dome)
pt_3 = Point(cone_dome)
